# Grasshopper definition 01_brick_wall.gh (Grasshopper 1.0.8)

brick_y_dimension = Slider(1, range=0.01..2)
brick_z_dimension = Slider(0.6, range=0.01..2)
number_of_rows = Slider(13, range=1..20)
number_of_columns = Slider(14, range=1..20)
# Brick wall
brick_x_dimension = Slider(2, range=0.01..2)
python_3_script = Python3Script(
    xsize=brick_x_dimension,
    ysize=brick_y_dimension,
    zsize=brick_z_dimension,
    row_count=number_of_rows,
    column_count=number_of_columns)  # -> brick_wall; inputs row_count: Int32, column_count: Int32
# ---------- python_3_script: Python ----------
# venv: caadria_b01

# 0. Import everything we will need
import math
from compas.geometry import Box, Point

# 1. Start with an empty list of bricks to be created
#    make sure to match the name of this list to the output of this component!
brick_wall = []
mortar_gap = 0.05

# 2. Create two for loops, one nested inside the other,
#    to iterate over the range of row_count and column_count
for row in range(row_count):
    for col in range(column_count):

        # 3. If the row is odd, calculate an offset of half the size in X
        if row % 2 == 1:
            offset = xsize / 2
        else:
            offset = 0

        # 4. Define the variables x, y, z based on the current column, row
        #    and the inputs for sizes, mortar gaps and offset
        x = (col * (xsize + mortar_gap)) + offset
        y = 0
        z = row * (zsize + mortar_gap)
        
        # 5. Create a new box
        box = Box(xsize, ysize, zsize)

        # 6. Move brick to the correct location
        box.frame.point = Point(x, y, z)

        # 7. Append the brick to the output list
        brick_wall.append(box)
# ---------- end python_3_script ----------

rotation_factor = Slider(-3.78, range=-10..10)
attractor_point = Point(Point(12.00879894, -2.922883148, 0.1231497297))

brick_x_dimension_2 = Slider(2, range=0.01..2)
brick_y_dimension_2 = Slider(1, range=0.01..2)
brick_z_dimension_2 = Slider(0.6, range=0.01..2)
number_of_rows_2 = Slider(13, range=1..20)
number_of_columns_2 = Slider(14, range=1..20)
python_3_script_2 = Python3Script(
    xsize=brick_x_dimension_2,
    ysize=brick_y_dimension_2,
    zsize=brick_z_dimension_2,
    row_count=number_of_rows_2,
    column_count=number_of_columns_2,
    rotation_factor=rotation_factor)  # -> brick_wall; inputs row_count: Int32, column_count: Int32
# ---------- python_3_script_2: Python ----------
"""
## Challenge 01

Rotate the bricks following any logic you want, for example, according
to their distance from a reference point (attractor point) in 3D space.
The rotation will create a visual pattern that is very recognizable as computational design aesthetics.
This is an essential exercise in computational design, as you will learn how to bring
different things into a numerical relationship.

### Details

- Starting point is your script of the main task, most things remain the same but after
  moving the brick to its position, you will add a rotation.
- Rotations are done using the method `.rotate()` inside the frame of an object.
  For example, to rotate a box around the point (0, 0, 0), you can do:
      box.frame.rotate(3.14 / 2, point=(0, 0, 0))
  Notice that the angle of rotation is in RADIANS, not degrees.
  You can find more details in the the API reference of COMPAS framework for the class `Frame`.
- The amount of rotation can be determined by any logic of your choice: fixed, random, based 
  on arithmetic, based on geometry (e.g. euclidean distance), based on maths (e.g. apply
  the math.sin function to a value), etc.

### Bonus

- If you use an attractor point as reference, you can choose to use a referenced point
  from Grasshopper instead of hard-coding the attractor point.

"""
# venv: caadria_b01

# 0. Import everything we will need
import math
from compas.geometry import Box, Point

# 1. Start with an empty list of bricks to be created
#    make sure to match the name of this list to the output of this component!
brick_wall = []
mortar_gap = 0.05

# 2. Create two for loops, one nested inside the other,
#    to iterate over the range of row_count and column_count
for row in range(row_count):
    for col in range(column_count):

        # 3. If the row is odd, calculate an offset of half the size in X
        if row % 2 == 1:
            offset = xsize / 2
        else:
            offset = 0

        # 4. Define the variables x, y, z based on the current column, row
        #    and the inputs for sizes, mortar gaps and offset
        x = (col * (xsize + mortar_gap)) + offset
        y = 0
        z = row * (zsize + mortar_gap)

        # 5 Create a new box
        box = Box(xsize, ysize, zsize)

        # 6. Move brick to the correct location
        box.frame.point = Point(x, y, z)
        
        # 7. Rotate brick based on some logic
        #     For example, calculate the distance from the center point of the brick (x, y, z)
        #     to a reference point (either hard-coded here or referenced adding an input parameter)
        #     Hint: the formula for distance requires using square root, in python `math.sqrt`
        #           and it is as follows:
        #           math.sqrt((x2 - x1)**2 + (y2 - y1)**2 + (z2 - z1)**2)
        distance = math.sqrt((10 + x)**2 + (5 + z)**2)
        box.frame.rotate(math.radians(distance * rotation_factor), point=box.frame.point)

        # 8. Append the brick to the output list
        brick_wall.append(box)
# ---------- end python_3_script_2 ----------

rotation_factor_2 = Slider(-10, range=-10..10)
attractor_point_2 = Point(Point(5.875651564, -0.8964614463, 0.1231497297))

brick_x_dimension_3 = Slider(2, range=0.01..2)
brick_y_dimension_3 = Slider(1, range=0.01..2)
number_of_rows_3 = Slider(13, range=1..20)
brick_z_dimension_3 = Slider(0.6, range=0.01..2)
number_of_columns_3 = Slider(14, range=1..20)
python_3_script_3 = Python3Script(
    xsize=brick_x_dimension_3,
    ysize=brick_y_dimension_3,
    zsize=brick_z_dimension_3,
    row_count=number_of_rows_3,
    column_count=number_of_columns_3,
    rotation_factor=rotation_factor_2)  # -> brick_wall; inputs row_count: Int32, column_count: Int32
# ---------- python_3_script_3: Python ----------
# venv: caadria_b01

# 0. Import everything we will need
import math
from compas.geometry import Box, Point

# 1. Start with an empty list of bricks to be created
#    make sure to match the name of this list to the output of this component!
brick_wall = []
mortar_gap = 0.05

# 2. Create two for loops, one nested inside the other,
#    to iterate over the range of row_count and column_count
for row in range(row_count):
    for col in range(column_count):

        # 3. If the row is odd, calculate an offset of half the size in X
        if row % 2 == 1:
            offset = xsize / 2
        else:
            offset = 0

        # 4. Define the variables x, y, z based on the current column, row
        #    and the inputs for sizes, mortar gaps and offset
        x = (col * (xsize + mortar_gap)) + offset
        y = 0
        z = row * (zsize + mortar_gap)

        # 5. Assign a boolean variable is_halfbrick 
        #    based on conditionally checking the criteria for half bricks
        if row % 2 == 0 and col == 0:
            is_halfbrick = True
        elif row % 2 == 1 and col == column_count - 1:
            is_halfbrick = True
        else:
            is_halfbrick = False

        # 6. Create a new box taking into account that half-bricks need to be half the X size
        if is_halfbrick:
            box = Box(xsize / 2, ysize, zsize)
        else:
            box = Box(xsize, ysize, zsize)

        # 7. If it's a half brick...
        if is_halfbrick:
            # 8. Move the x coordinate left or right depending on weather it's first or last
            if col == 0:
                x = x + box.xsize / 2
            if col == column_count - 1:
                x = x - box.xsize / 2

        # 9. Move brick to the correct location
        box.frame.point = Point(x, y, z)
        
        # 10. Rotate brick based on some logic
        #     For example, calculate the distance from the center point of the brick (x, y, z)
        #     to a reference point (either hard-coded here or referenced adding an input parameter)
        #     Hint: the formula for distance requires using square root, in python `math.sqrt`
        #           and it is as follows:
        #           math.sqrt((x2 - x1)**2 + (y2 - y1)**2 + (z2 - z1)**2)
        distance = math.sqrt((10 + x)**2 + (5 + z)**2)
        box.frame.rotate(math.radians(distance * rotation_factor), point=box.frame.point)

        # 11. Append the brick to the output list
        brick_wall.append(box)
# ---------- end python_3_script_3 ----------

# ----
# Optional
# Optional
compas_draw = COMPASDraw(cg=python_3_script)  # -> rg
#   port cg: The COMPAS geometry or datastructure to be drawn.
#   port rg: The Rhino geometry object.
# ---------- compas_draw: Python ----------
# venv: caadria_b01
"""
Draws COMPAS geometry in Grasshopper.
"""

from typing import Any

import Grasshopper

from compas.scene import SceneObject


class CompasToRhinoGeometry(Grasshopper.Kernel.GH_ScriptInstance):
    def RunScript(self, cg):
        if not cg:
            return None

        return SceneObject(item=cg).draw()
# ---------- end compas_draw ----------
preview = CustomPreview(
    Geometry=compas_draw,
    Material={diffuse=RGB(197, 130, 64), emission=RGB(68, 53, 68), shine=0.5, specular=RGB(255, 254, 254), transparency=0})
compas_draw_2 = COMPASDraw(cg=python_3_script_2)  # -> rg; same code as compas_draw
preview_2 = CustomPreview(
    Geometry=compas_draw_2,
    Material={diffuse=RGB(197, 130, 64), emission=RGB(68, 53, 68), shine=0.5, specular=RGB(255, 254, 254), transparency=0})
compas_draw_3 = COMPASDraw(cg=python_3_script_3)  # -> rg; same code as compas_draw
preview_3 = CustomPreview(
    Geometry=compas_draw_3,
    Material={diffuse=RGB(197, 130, 64), emission=RGB(68, 53, 68), shine=0.5, specular=RGB(255, 254, 254), transparency=0})
