# Grasshopper definition 03_mesh_with_scene.ghx (Grasshopper 1.0.8)

mesh = Python3Script()  # -> out, mesh, geo
# ---------- mesh: Python ----------
# venv: caadria_b01

import compas
from compas.datastructures import Mesh
from compas.scene import Scene

mesh = Mesh.from_obj(compas.get("tubemesh.obj"))

scene = Scene()
scene.add(mesh)
geo = scene.draw()
# ---------- end mesh ----------
