# Grasshopper definition a00_compas-timber.ghx (Grasshopper 1.0.8)

# ----
# COMPAS Timber - Direct Joint
# Direct Joint Assignments
curve = Curve([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])
ct_model = Python3Script(lines=curve)  # -> geo; inputs lines: list of Line
# ---------- ct_model: Python ----------
# r: compas==2.15.1,timber_design==0.1.0
# venv: ca-fs26-final-project

from compas_rhino.conversions import line_to_compas
from compas_timber.connections import XLapJoint
from compas_timber.elements import Beam
from compas_timber.model import TimberModel

width = 0.06
height = 0.08
z_vector = (0, 0, 1)

model = TimberModel()
for line in lines:
    line = line_to_compas(line)
    beam = Beam.from_centerline(centerline=line, width=width, height=height, z_vector=z_vector)
    model.add_element(beam)

beams = list(model.beams)
XLapJoint.create(model, beams[0], beams[1], False, cut_plane_bias=0.5)
XLapJoint.create(model, beams[1], beams[2], True, cut_plane_bias=0.5)
XLapJoint.create(model, beams[2], beams[0], True, cut_plane_bias=0.5)

model.process_joinery()

geo = []
for beam in model.beams:
    geo.append(beam.geometry)
# ---------- end ct_model ----------
compas_draw = COMPASDraw(cg=ct_model)  # -> rg
#   port cg: The COMPAS geometry or datastructure to be drawn.
#   port rg: The Rhino geometry object.
# ---------- compas_draw: Python ----------
# r: compas==2.15.1,timber_design==0.1.0
# venv: ca-fs26-final-project

"""
Draws COMPAS geometry in Grasshopper.
"""

from typing import Any

import Grasshopper

from compas.scene import SceneObject


class CompasToRhinoGeometry(Grasshopper.Kernel.GH_ScriptInstance):
    def RunScript(self, cg):
        if not cg:
            return None

        return SceneObject(item=cg).draw()
# ---------- end compas_draw ----------

# ----
# COMPAS Timber - Joint Rules
# Direct Rules
lines = Curve([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])
ct_model_2 = Python3Script(lines=lines)  # -> geo; inputs lines: list of Line
# ---------- ct_model_2: Python ----------
# r: compas==2.15.1,timber_design==0.1.0
# venv: ca-fs26-final-project

from compas_rhino.conversions import line_to_compas
from compas_timber.connections import XLapJoint, TButtJoint, LMiterJoint, JointTopology
from compas_timber.elements import Beam
from compas_timber.model import TimberModel

from timber_design.workflow import DirectRule, JointRuleSolver, TopologyRule, CategoryRule

width = 0.06
height = 0.08
z_vector = (0, 0, 1)

# ---------- TIMBER MODEL WITH DIRECT RULE-ASSIGNMENT ---------- #

model = TimberModel()

for line in lines:
    line = line_to_compas(line)
    beam = Beam.from_centerline(centerline=line, width=width, height=height, z_vector=z_vector)
    model.add_element(beam)

beams = list(model.beams)
# Direct rule assignment for specific beams
rules = [
    DirectRule(XLapJoint, [beams[0], beams[1]]),
    DirectRule(XLapJoint, [beams[1], beams[2]]),
    DirectRule(XLapJoint, [beams[2], beams[0]])
]

solver = JointRuleSolver(rules)
solver.apply_rules_to_model(model)

model.process_joinery()

geo = [beam.geometry for beam in model.beams]
# ---------- end ct_model_2 ----------
compas_draw_2 = COMPASDraw(cg=ct_model_2)  # -> rg
#   port cg: The COMPAS geometry or datastructure to be drawn.
#   port rg: The Rhino geometry object.
# ---------- compas_draw_2: Python ----------
# r: compas==2.15.1,timber_design==0.1.0
# venv: ca-fs26-final-project
"""
Draws COMPAS geometry in Grasshopper.
"""

from typing import Any

import Grasshopper

from compas.scene import SceneObject


class CompasToRhinoGeometry(Grasshopper.Kernel.GH_ScriptInstance):
    def RunScript(self, cg):
        if not cg:
            return None

        return SceneObject(item=cg).draw()
# ---------- end compas_draw_2 ----------

# ----
# Categories
lines_a = Curve([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])
lines_b = Curve([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])
ct_model_3 = Python3Script(lines_a=lines_a, category_a="outer", lines_b=lines_b, category_b="inner")  # -> geo; inputs lines_a: list of Line, category_a: String, lines_b: list of Line, category_b: String
# ---------- ct_model_3: Python ----------
# r: compas==2.15.1,timber_design==0.1.0
# venv: ca-fs26-final-project

from compas_rhino.conversions import line_to_compas
from compas_timber.connections import XLapJoint, TButtJoint, LButtJoint
from compas_timber.elements import Beam
from compas_timber.model import TimberModel

from timber_design.workflow import DirectRule, JointRuleSolver, TopologyRule, CategoryRule

width = 0.06
height = 0.08
z_vector = (0, 0, 1)

# ---------- RULE-BASED TIMBER MODEL WITH JOINTS ---------- #

model = TimberModel()

# lines_a, lines_b, category_a, category_b are provided as inputs
for line in lines_a:
    beam = Beam.from_centerline(line_to_compas(line), width, height, z_vector=z_vector)
    beam.attributes["category"] = category_a
    model.add_element(beam)

for line in lines_b:
    beam = Beam.from_centerline(line_to_compas(line), width, height, z_vector=z_vector)
    beam.attributes["category"] = category_b
    model.add_element(beam)

# Define rule for joints between category_a and category_b
rule1 = CategoryRule(TButtJoint, category_b, category_a)
rule2 = CategoryRule(XLapJoint, category_b, category_b)
rule3 = CategoryRule(LButtJoint, category_a, category_a)

# Use JointRuleSolver to apply rules
solver = JointRuleSolver([rule1, rule2, rule3])
solver.apply_rules_to_model(model)

model.process_joinery()

geo = [beam.geometry for beam in model.beams]
# ---------- end ct_model_3 ----------
compas_draw_3 = COMPASDraw(cg=ct_model_3)  # -> rg; same code as compas_draw_2

# ----
# Topology
lines_a_2 = Curve([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])
lines_b_2 = Curve([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])
ct_model_4 = Python3Script(lines=[lines_a_2, lines_b_2])  # -> geo; inputs lines: list of Line
# ---------- ct_model_4: Python ----------
# r: compas==2.15.1,timber_design==0.1.0
# venv: ca-fs26-final-project

from compas_rhino.conversions import line_to_compas
from compas_timber.connections import XLapJoint, TButtJoint, LMiterJoint, JointTopology
from compas_timber.elements import Beam
from compas_timber.model import TimberModel

from timber_design.workflow import DirectRule, JointRuleSolver, TopologyRule, CategoryRule

width = 0.06
height = 0.08
z_vector = (0, 0, 1)

# ----------- TOPOLOGICAL RULE-BASED TIMBER MODEL WITH JOINTS ---------- #

model = TimberModel()

for line in lines:
    line = line_to_compas(line)
    beam = Beam.from_centerline(centerline=line, width=width, height=height, z_vector=z_vector)
    model.add_element(beam)

# Define rules based on topology (X, T, and L joints)
rules = [
    TopologyRule(JointTopology.TOPO_X, XLapJoint),
    TopologyRule(JointTopology.TOPO_T, TButtJoint),
    TopologyRule(JointTopology.TOPO_L, LMiterJoint)
]

# Apply all rules using the solver
solver = JointRuleSolver(rules)
solver.apply_rules_to_model(model)

model.process_joinery()

geo = [beam.geometry for beam in model.beams]
# ---------- end ct_model_4 ----------
compas_draw_4 = COMPASDraw(cg=ct_model_4)  # -> rg; same code as compas_draw_2

# ----
# A00 Compas Timber - Ungraded
# Gramazio Kohler Research
# Gonzalo Casas, Lorin Wiedemeier, Eric Gozzi
# COMPAS Timber Model - From Lines
centerline_model = Line([Line((-3.509972934, -1.492152993, 2.22874718), (-3.509972934, -0.4188767486, 3.073171606)), Line((-3.509972934, -1.492152993, 2.22874718), (-2.4270184, -1.492152993, 3.073686963)), Line((-3.509972934, -0.1606205973, 3.23041945), (-2.161675054, -0.7695668304, 3.659802426)), Line((-3.509972934, -0.4188767486, 3.073171606), (-3.509972934, 0.9424020442, 3.701431926)), Line((-3.509972934, 1.253299248, 3.775463882), (-2.148966267, 0.3799502445, 4.128895601)), Line((-3.509972934, 0.9424020442, 3.701431926), (-3.509972934, 1.989048229, 3.84778377))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])
ct_from_lines = Python3Script(
    lines=centerline_model,
    beam_width=Slider(0.08, range=0..0.1),
    beam_height=Slider(0.1, range=0..0.1),
    process_joinery=Toggle(True))  # -> beams; inputs lines: list of Line, beam_width: Double, beam_height: Double, process_joinery: Boolean
# ---------- ct_from_lines: Python ----------
# r: compas==2.15.1,timber_design==0.1.0
# venv: ca-fs26-final-project

from compas_rhino.devtools import DevTools
DevTools.ensure_path()

# --------------------------------------------------
# ------------------- YOUR CODE --------------------
from compas_rhino.conversions import line_to_compas
from a00_timber_model import TimberModelCreator

lines = [line_to_compas(line) for line in lines]

creator = TimberModelCreator(lines, beam_width, beam_height)
timber_model = creator.create_timber_model(process_joinery=process_joinery)

beams = [beam.geometry for beam in timber_model.beams]
# ---------- end ct_from_lines ----------
# Solution
compas_draw_5 = COMPASDraw(cg=ct_from_lines)  # -> rg; same code as compas_draw_2

# ----
# COMPAS Timber Model - From Mesh
mesh = Mesh(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)
# Note: Joints are nonsensical
toggle = BooleanToggle(True)
ct_from_mesh = Python3Script(mesh=mesh, beam_width=Slider(0.08, range=0..0.1), beam_height=Slider(0.1, range=0..0.1), process_joinery=toggle)  # -> beams; inputs mesh: Mesh, beam_width: Double, beam_height: Double, process_joinery: Boolean
# ---------- ct_from_mesh: Python ----------
# r: compas==2.15.1,timber_design==0.1.0
# venv: ca-fs26-final-project

from compas_rhino.devtools import DevTools
DevTools.ensure_path()
print(DevTools.ensure_path())

# --------------------------------------------------
# ------------------- YOUR CODE --------------------
from a00_timber_model import TimberModelCreator
from compas_rhino.conversions import mesh_to_compas

mesh = mesh_to_compas(mesh)

creator = TimberModelCreator.from_mesh(mesh, beam_width, beam_height)
timber_model = creator.create_timber_model(process_joinery=process_joinery)

beams = [beam.geometry for beam in timber_model.beams]
# ---------- end ct_from_mesh ----------
compas_draw_6 = COMPASDraw(cg=ct_from_mesh)  # -> rg; same code as compas_draw_2

reloader = CompasDevReloader()
# ---------- reloader: Python ----------
"""
------------------------------
Using VS Code as Python editor
------------------------------

The simplest way to start using VS Code as our editor, is
to place our Python code in files located IN THE SAME FOLDER as our Grasshopper file.

After we have done that, we need 2 steps: 

1. Enable the COMPAS reloader on one component. This tells Grasshopper to watch for changes in the Pythoh files and reload if changed.
2. Every other component that uses Python code from external files needs to start with a method to ensure Grasshopper knows where to load the files from.

"""
# r: compas==2.15.1,timber_design==0.1.0
# venv: ca-fs26-final-project

from compas_rhino.devtools import DevTools
DevTools.enable_reloader()
# ---------- end reloader ----------
