# Grasshopper definition a01-brick-wall.gh (Grasshopper 1.0.8)

brick_x_dimension = Slider(2, range=0.01..2)
brick_y_dimension = Slider(1, range=0.01..2)
brick_z_dimension = Slider(0.6, range=0.01..2)
number_of_rows = Slider(13, range=1..20)
number_of_columns = Slider(14, range=1..20)
python_3_script = Python3Script(
    xsize=brick_x_dimension,
    ysize=brick_y_dimension,
    zsize=brick_z_dimension,
    row_count=number_of_rows,
    column_count=number_of_columns)  # -> brick_wall; inputs row_count: Int32, column_count: Int32
# ---------- python_3_script: Python ----------
"""
### Main Task

- Create a virtual brick wall using Python and the COMPAS framework. 
- Your brick dimensions as well as wall height and length should react parametrically to 
the provided input sliders.
- Implement the wall such that every other row is offset by half the brick's length to mimic 
a strecher bond pattern.

### Details

- Create a Python script that generates a 3D representation of a brick wall.
- Each brick should be represented as an instance of the `Box` class from the COMPAS geometry 
module.
- Create a fully parametric brick wall by making use of the provided number sliders:
  - Use the input sliders for the brick dimensions (`xsize`, `ysize` and `zsize`).
  - Use the input sliders for the number of rows and columns(`row_count` and `column_count`) to 
  control the number of bricks in both directions.
- Ensure that the data type of the input sliders matches those specified on the prepared 
number sliders. (Right-click each of the inputs and navigate to **Type hint**.)

### Bonus Tasks

- Introduce a mortar gap (Moertelfuge) between the bricks of a fixed size across all bricks. 
  Ensure that the gap size is consistent across all bricks.

### Functions, Classes, Methods, and Statements You Will Need

- Geometric types (`Box`, `Point` from COMPAS).
- Loop statements (for loops for generating rows and columns).
- Conditional statements (for applying row offset).

"""
# r: compas
# venv: ca-hs25

# 0. Import everything we will need
import math
from compas.geometry import Box, Point

# 1. Start with an empty list of bricks to be created
#    make sure to match the name of this list to the output of this component!
brick_wall = []
mortar_gap = 0.05

# 2. Create two for loops, one nested inside the other,
#    to iterate over the range of row_count and column_count
for row in range(row_count):
    for col in range(column_count):

        # 3. If the row is odd, calculate an offset of half the size in X
        if row % 2 == 1:
            offset = xsize / 2
        else:
            offset = 0

        # 4. Define the variables x, y, z based on the current column, row
        #    and the inputs for sizes, mortar gaps and offset
        x = (col * (xsize + mortar_gap)) + offset
        y = 0
        z = row * (zsize + mortar_gap)
        
        # 5. Create a new box
        box = Box(xsize, ysize, zsize)

        # 6. Move brick to the correct location
        box.frame.point = Point(x, y, z)

        # 7. Append the brick to the output list
        brick_wall.append(box)
# ---------- end python_3_script ----------

# ----
# Main Task
# Main Task
# Double click button
# Assignment 01
# Main Task:
brick_x_dimension_2 = Slider(2, range=0.01..2)
brick_y_dimension_2 = Slider(1, range=0.01..2)
brick_z_dimension_2 = Slider(0.6, range=0.01..2)
number_of_rows_2 = Slider(13, range=1..20)
number_of_columns_2 = Slider(14, range=1..20)
# Main Task: ### Main Task
# 
# - Create a virtual brick wall using Python and the COMPAS framework.
# - Your brick dimensions as well as wall height and length should react parametrically to
# the provided input sliders.
# - Implement the wall such that every other row is offset by half the brick's length to mimic
# a strecher bond pattern.
# 
# ### Details
# 
# - Create a Python script that generates a 3D representation of a brick wall.
# - Each brick should be represented as an instance of the `Box` class from the COMPAS geometry
# module.
# - Create a fully parametric brick wall by making use of the provided number sliders:
#   - Use the input sliders for the brick dimensions (`xsize`, `ysize` and `zsize`).
#   - Use the input sliders for the number of rows and columns(`row_count` and `column_count`) to
#   control the number of bricks in both directions.
# - Ensure that the data type of the input sliders matches those specified on the prepared
# number sliders. (Right-click each of the inputs and navigate to **Type hint**.)
# 
# ### Bonus Tasks
# 
# - Introduce a mortar gap (Moertelfuge) between the bricks of a fixed size across all bricks.
#   Ensure that the gap size is consistent across all bricks.
# 
# ### Functions, Classes, Methods, and Statements You Will Need
# 
# - Geometric types (`Box`, `Point` from COMPAS).
# - Loop statements (for loops for generating rows and columns).
# - Conditional statements (for applying row offset).
# Remember the
# type hints
python_3_script_2 = Python3Script(
    xsize=brick_x_dimension_2,
    ysize=brick_y_dimension_2,
    zsize=brick_z_dimension_2,
    row_count=number_of_rows_2,
    column_count=number_of_columns_2)  # -> brick_wall; inputs row_count: Int32, column_count: Int32
# ---------- python_3_script_2: Python ----------
"""
### Main Task

- Create a virtual brick wall using Python and the COMPAS framework. 
- Your brick dimensions as well as wall height and length should react parametrically to 
the provided input sliders.
- Implement the wall such that every other row is offset by half the brick's length to mimic 
a strecher bond pattern.

### Details

- Create a Python script that generates a 3D representation of a brick wall.
- Each brick should be represented as an instance of the `Box` class from the COMPAS geometry 
module.
- Create a fully parametric brick wall by making use of the provided number sliders:
  - Use the input sliders for the brick dimensions (`xsize`, `ysize` and `zsize`).
  - Use the input sliders for the number of rows and columns(`row_count` and `column_count`) to 
  control the number of bricks in both directions.
- Ensure that the data type of the input sliders matches those specified on the prepared 
number sliders. (Right-click each of the inputs and navigate to **Type hint**.)

### Bonus Tasks

- Introduce a mortar gap (Moertelfuge) between the bricks of a fixed size across all bricks. 
  Ensure that the gap size is consistent across all bricks.

### Functions, Classes, Methods, and Statements You Will Need

- Geometric types (`Box`, `Point` from COMPAS).
- Loop statements (for loops for generating rows and columns).
- Conditional statements (for applying row offset).

"""
# r: compas
# venv: ca-hs25

# 0. Import everything we will need
import math
from compas.geometry import Box, Point

# 1. Start with an empty list of bricks to be created
#    make sure to match the name of this list to the output of this component!
# [ADD YOUR CODE HERE...]
brick_wall = .....

# 2. Create two for loops, one nested inside the other,
#    to iterate over the range of row_count and column_count
# [ADD YOUR CODE HERE...]

        # 3. If the row is odd, calculate an offset of half the size in X
        # [ADD YOUR CODE HERE...]

        # 4. Define the variables x, y, z based on the current column, row
        #    and the inputs for sizes, mortar gaps and offset
        # [ADD YOUR CODE HERE...]

        # 5. Create a new box
        # [ADD YOUR CODE HERE...]

        # 6. Move brick to the correct location
        # [ADD YOUR CODE HERE...]
        
        # 7. Append the brick to the output list
        # [ADD YOUR CODE HERE...]
# ---------- end python_3_script_2 ----------

# ----
# Preview
compas_draw = COMPASDraw(cg=python_3_script_2)  # -> rg
#   port cg: The COMPAS geometry or datastructure to be drawn.
#   port rg: The Rhino geometry object.
# ---------- compas_draw: Python ----------
# r: compas
# venv: ca-hs25
"""
Draws COMPAS geometry in Grasshopper.
"""

from typing import Any

import Grasshopper

from compas.scene import SceneObject


class CompasToRhinoGeometry(Grasshopper.Kernel.GH_ScriptInstance):
    def RunScript(self, cg):
        if not cg:
            return None

        return SceneObject(item=cg).draw()
# ---------- end compas_draw ----------
preview = CustomPreview(
    Geometry=compas_draw,
    Material={diffuse=RGB(197, 130, 64), emission=RGB(68, 53, 68), shine=0.5, specular=RGB(255, 254, 254), transparency=0})

# ----
# Optional
rotation_factor = Slider(-4.73, range=-10..10)
# Remember the
# type hints
attractor_point = Point(Point(5.875651564, -0.8964614463, 0.1231497297))

# ----
# Challenge 01
# Challenge 01
# Double click button
# Challenge 01:
brick_x_dimension_3 = Slider(2, range=0.01..2)
brick_y_dimension_3 = Slider(1, range=0.01..2)
brick_z_dimension_3 = Slider(0.6, range=0.01..2)
number_of_rows_3 = Slider(13, range=1..20)
number_of_columns_3 = Slider(14, range=1..20)
# Challenge 01: ## Challenge 01
# 
# Rotate the bricks following any logic you want, for example, according
# to their distance from a reference point (attractor point) in 3D space.
# The rotation will create a visual pattern that is very recognizable as computational design aesthetics.
# This is an essential exercise in computational design, as you will learn how to bring
# different things into a numerical relationship.
# 
# ### Details
# 
# - Starting point is your script of the main task, most things remain the same but after
#   moving the brick to its position, you will add a rotation.
# - Rotations are done using the method `.rotate()` inside the frame of an object.
#   For example, to rotate a box around the point (0, 0, 0), you can do:
#       box.frame.rotate(3.14 / 2, point=(0, 0, 0))
#   Notice that the angle of rotation is in RADIANS, not degrees.
#   You can find more details in the the API reference of COMPAS framework for the class `Frame`.
# - The amount of rotation can be determined by any logic of your choice: fixed, random, based
#   on arithmetic, based on geometry (e.g. euclidean distance), based on maths (e.g. apply
#   the math.sin function to a value), etc.
# 
# ### Bonus
# 
# - If you use an attractor point as reference, you can choose to use a referenced point
#   from Grasshopper instead of hard-coding the attractor point.
python_3_script_3 = Python3Script(
    xsize=brick_x_dimension_3,
    ysize=brick_y_dimension_3,
    zsize=brick_z_dimension_3,
    row_count=number_of_rows_3,
    column_count=number_of_columns_3,
    rotation_factor=rotation_factor)  # -> brick_wall; inputs row_count: Int32, column_count: Int32
# ---------- python_3_script_3: Python ----------
"""
## Challenge 01

Rotate the bricks following any logic you want, for example, according
to their distance from a reference point (attractor point) in 3D space.
The rotation will create a visual pattern that is very recognizable as computational design aesthetics.
This is an essential exercise in computational design, as you will learn how to bring
different things into a numerical relationship.

### Details

- Starting point is your script of the main task, most things remain the same but after
  moving the brick to its position, you will add a rotation.
- Rotations are done using the method `.rotate()` inside the frame of an object.
  For example, to rotate a box around the point (0, 0, 0), you can do:
      box.frame.rotate(3.14 / 2, point=(0, 0, 0))
  Notice that the angle of rotation is in RADIANS, not degrees.
  You can find more details in the the API reference of COMPAS framework for the class `Frame`.
- The amount of rotation can be determined by any logic of your choice: fixed, random, based 
  on arithmetic, based on geometry (e.g. euclidean distance), based on maths (e.g. apply
  the math.sin function to a value), etc.

### Bonus

- If you use an attractor point as reference, you can choose to use a referenced point
  from Grasshopper instead of hard-coding the attractor point.

"""
# r: compas
# venv: ca-hs25

# 0. Import everything we will need
import math
from compas.geometry import Box, Point

# 1. Start with an empty list of bricks to be created
#    make sure to match the name of this list to the output of this component!
# [ADD YOUR CODE HERE...]
brick_wall = .....

# 2. Create two for loops, one nested inside the other,
#    to iterate over the range of row_count and column_count
# [ADD YOUR CODE HERE...]

        # 3. If the row is odd, calculate an offset of half the size in X
        # [ADD YOUR CODE HERE...]

        # 4. Define the variables x, y, z based on the current column, row
        #    and the inputs for sizes, mortar gaps and offset
        # [ADD YOUR CODE HERE...]

        # 5. Create a new box
        # [ADD YOUR CODE HERE...]

        # 6. Move brick to the correct location
        # [ADD YOUR CODE HERE...]
        
        # 7. Rotate brick based on some logic
        #     For example, calculate the distance from the center point of the brick (x, y, z)
        #     to a reference point (either hard-coded here or referenced adding an input parameter)
        #     Hint: the formula for distance requires using square root, in python `math.sqrt`
        #           and it is as follows:
        #           math.sqrt((x2 - x1)**2 + (y2 - y1)**2 + (z2 - z1)**2)
        # [ADD YOUR CODE HERE...]

        # 8. Append the brick to the output list
        # [ADD YOUR CODE HERE...]
# ---------- end python_3_script_3 ----------

rotation_factor_2 = Slider(-3.78, range=-10..10)
attractor_point_2 = Point(Point(5.875651564, -0.8964614463, 0.1231497297))

brick_x_dimension_4 = Slider(2, range=0.01..2)
brick_y_dimension_4 = Slider(1, range=0.01..2)
brick_z_dimension_4 = Slider(0.6, range=0.01..2)
number_of_rows_4 = Slider(13, range=1..20)
number_of_columns_4 = Slider(14, range=1..20)
python_3_script_4 = Python3Script(
    xsize=brick_x_dimension_4,
    ysize=brick_y_dimension_4,
    zsize=brick_z_dimension_4,
    row_count=number_of_rows_4,
    column_count=number_of_columns_4,
    rotation_factor=rotation_factor_2)  # -> brick_wall; inputs row_count: Int32, column_count: Int32
# ---------- python_3_script_4: Python ----------
"""
## Challenge 01

Rotate the bricks following any logic you want, for example, according
to their distance from a reference point (attractor point) in 3D space.
The rotation will create a visual pattern that is very recognizable as computational design aesthetics.
This is an essential exercise in computational design, as you will learn how to bring
different things into a numerical relationship.

### Details

- Starting point is your script of the main task, most things remain the same but after
  moving the brick to its position, you will add a rotation.
- Rotations are done using the method `.rotate()` inside the frame of an object.
  For example, to rotate a box around the point (0, 0, 0), you can do:
      box.frame.rotate(3.14 / 2, point=(0, 0, 0))
  Notice that the angle of rotation is in RADIANS, not degrees.
  You can find more details in the the API reference of COMPAS framework for the class `Frame`.
- The amount of rotation can be determined by any logic of your choice: fixed, random, based 
  on arithmetic, based on geometry (e.g. euclidean distance), based on maths (e.g. apply
  the math.sin function to a value), etc.

### Bonus

- If you use an attractor point as reference, you can choose to use a referenced point
  from Grasshopper instead of hard-coding the attractor point.

"""
# r: compas
# venv: ca-hs25

# 0. Import everything we will need
import math
from compas.geometry import Box, Point

# 1. Start with an empty list of bricks to be created
#    make sure to match the name of this list to the output of this component!
brick_wall = []
mortar_gap = 0.05

# 2. Create two for loops, one nested inside the other,
#    to iterate over the range of row_count and column_count
for row in range(row_count):
    for col in range(column_count):

        # 3. If the row is odd, calculate an offset of half the size in X
        if row % 2 == 1:
            offset = xsize / 2
        else:
            offset = 0

        # 4. Define the variables x, y, z based on the current column, row
        #    and the inputs for sizes, mortar gaps and offset
        x = (col * (xsize + mortar_gap)) + offset
        y = 0
        z = row * (zsize + mortar_gap)

        # 5 Create a new box
        box = Box(xsize, ysize, zsize)

        # 6. Move brick to the correct location
        box.frame.point = Point(x, y, z)
        
        # 7. Rotate brick based on some logic
        #     For example, calculate the distance from the center point of the brick (x, y, z)
        #     to a reference point (either hard-coded here or referenced adding an input parameter)
        #     Hint: the formula for distance requires using square root, in python `math.sqrt`
        #           and it is as follows:
        #           math.sqrt((x2 - x1)**2 + (y2 - y1)**2 + (z2 - z1)**2)
        distance = math.sqrt((10 + x)**2 + (5 + z)**2)
        box.frame.rotate(math.radians(distance * rotation_factor), point=box.frame.point)

        # 8. Append the brick to the output list
        brick_wall.append(box)
# ---------- end python_3_script_4 ----------

# ----
# Preview
compas_draw_2 = COMPASDraw(cg=python_3_script_3)  # -> rg; same code as compas_draw
preview_2 = CustomPreview(
    Geometry=compas_draw_2,
    Material={diffuse=RGB(197, 130, 64), emission=RGB(68, 53, 68), shine=0.5, specular=RGB(255, 254, 254), transparency=0})

rotation_factor_3 = Slider(-10, range=-10..10)
attractor_point_3 = Point(Point(5.875651564, -0.8964614463, 0.1231497297))

brick_x_dimension_5 = Slider(2, range=0.01..2)
brick_y_dimension_5 = Slider(1, range=0.01..2)
brick_z_dimension_5 = Slider(0.6, range=0.01..2)
number_of_rows_5 = Slider(13, range=1..20)
number_of_columns_5 = Slider(14, range=1..20)
python_3_script_5 = Python3Script(
    xsize=brick_x_dimension_5,
    ysize=brick_y_dimension_5,
    zsize=brick_z_dimension_5,
    row_count=number_of_rows_5,
    column_count=number_of_columns_5,
    rotation_factor=rotation_factor_3)  # -> brick_wall; inputs row_count: Int32, column_count: Int32
# ---------- python_3_script_5: Python ----------
"""
## Challenge 02

Improve the previous script (either with or without challenge 01) by introducing
half-bricks at the start and end of every other row. This will create a more
realistic and structurally sound brick pattern, similar to how bricks are laid
in typical stretcher bond.

### Details

- Modify your script to include half-bricks at the start or end of every other row.
- Find a way to differentiate between every other row of bricks to facilitate your placement logic of the half-bricks.
- Ensure the half-bricks are correctly proportioned, such that the wall ends are flush.
- Ensure the half-bricks are correctly positioned and aligned with the full bricks, taking into account the staggered pattern.

"""
# r: compas
# venv: ca-hs25

# 0. Import everything we will need
import math
from compas.geometry import Box, Point

# 1. Start with an empty list of bricks to be created
#    make sure to match the name of this list to the output of this component!
brick_wall = []
mortar_gap = 0.05

# 2. Create two for loops, one nested inside the other,
#    to iterate over the range of row_count and column_count
for row in range(row_count):
    for col in range(column_count):

        # 3. If the row is odd, calculate an offset of half the size in X
        if row % 2 == 1:
            offset = xsize / 2
        else:
            offset = 0

        # 4. Define the variables x, y, z based on the current column, row
        #    and the inputs for sizes, mortar gaps and offset
        x = (col * (xsize + mortar_gap)) + offset
        y = 0
        z = row * (zsize + mortar_gap)

        # 5. Assign a boolean variable is_halfbrick 
        #    based on conditionally checking the criteria for half bricks
        if row % 2 == 0 and col == 0:
            is_halfbrick = True
        elif row % 2 == 1 and col == column_count - 1:
            is_halfbrick = True
        else:
            is_halfbrick = False

        # 6. Create a new box taking into account that half-bricks need to be half the X size
        if is_halfbrick:
            box = Box(xsize / 2, ysize, zsize)
        else:
            box = Box(xsize, ysize, zsize)

        # 7. If it's a half brick...
        if is_halfbrick:
            # 8. Move the x coordinate left or right depending on weather it's first or last
            if col == 0:
                x = x + box.xsize / 2
            if col == column_count - 1:
                x = x - box.xsize / 2

        # 9. Move brick to the correct location
        box.frame.point = Point(x, y, z)
        
        # 10. Rotate brick based on some logic
        #     For example, calculate the distance from the center point of the brick (x, y, z)
        #     to a reference point (either hard-coded here or referenced adding an input parameter)
        #     Hint: the formula for distance requires using square root, in python `math.sqrt`
        #           and it is as follows:
        #           math.sqrt((x2 - x1)**2 + (y2 - y1)**2 + (z2 - z1)**2)
        distance = math.sqrt((10 + x)**2 + (5 + z)**2)
        box.frame.rotate(math.radians(distance * rotation_factor), point=box.frame.point)

        # 11. Append the brick to the output list
        brick_wall.append(box)
# ---------- end python_3_script_5 ----------

# ----
# Solutions
# Optional
# Optional
compas_draw_3 = COMPASDraw(cg=python_3_script)  # -> rg; same code as compas_draw
preview_3 = CustomPreview(
    Geometry=compas_draw_3,
    Material={diffuse=RGB(197, 130, 64), emission=RGB(68, 53, 68), shine=0.5, specular=RGB(255, 254, 254), transparency=0})
compas_draw_4 = COMPASDraw(cg=python_3_script_4)  # -> rg; same code as compas_draw
preview_4 = CustomPreview(
    Geometry=compas_draw_4,
    Material={diffuse=RGB(197, 130, 64), emission=RGB(68, 53, 68), shine=0.5, specular=RGB(255, 254, 254), transparency=0})
compas_draw_5 = COMPASDraw(cg=python_3_script_5)  # -> rg; same code as compas_draw
preview_5 = CustomPreview(
    Geometry=compas_draw_5,
    Material={diffuse=RGB(197, 130, 64), emission=RGB(68, 53, 68), shine=0.5, specular=RGB(255, 254, 254), transparency=0})

# ----
# Optional
rotation_factor_4 = Slider(0, range=-10..10)
# Remember the
# type hints
attractor_point_4 = Point(Point(5.875651564, -0.8964614463, 0.1231497297))

# ----
# Challenge 02:
brick_x_dimension_6 = Slider(2, range=0.01..2)
brick_y_dimension_6 = Slider(1, range=0.01..2)
brick_z_dimension_6 = Slider(0.6, range=0.01..2)
number_of_rows_6 = Slider(13, range=1..20)
number_of_columns_6 = Slider(14, range=1..20)
python_3_script_6 = Python3Script(
    xsize=brick_x_dimension_6,
    ysize=brick_y_dimension_6,
    zsize=brick_z_dimension_6,
    row_count=number_of_rows_6,
    column_count=number_of_columns_6,
    rotation_factor=rotation_factor_4)  # -> brick_wall; inputs row_count: Int32, column_count: Int32
# ---------- python_3_script_6: Python ----------
"""
## Challenge 02

Improve the previous script (either with or without challenge 01) by introducing
half-bricks at the start and end of every other row. This will create a more
realistic and structurally sound brick pattern, similar to how bricks are laid
in typical stretcher bond.

### Details

- Modify your script to include half-bricks at the start or end of every other row.
- Find a way to differentiate between every other row of bricks to facilitate your placement logic of the half-bricks.
- Ensure the half-bricks are correctly proportioned, such that the wall ends are flush.
- Ensure the half-bricks are correctly positioned and aligned with the full bricks, taking into account the staggered pattern.

"""
# r: compas
# venv: ca-hs25

# 0. Import everything we will need
import math
from compas.geometry import Box, Point

# 1. Start with an empty list of bricks to be created
#    make sure to match the name of this list to the output of this component!
# [ADD YOUR CODE HERE...]
brick_wall = .....

# 2. Create two for loops, one nested inside the other,
#    to iterate over the range of row_count and column_count
# [ADD YOUR CODE HERE...]

        # 3. If the row is odd, calculate an offset of half the size in X
        # [ADD YOUR CODE HERE...]

        # 4. Define the variables x, y, z based on the current column, row
        #    and the inputs for sizes, mortar gaps and offset
        # [ADD YOUR CODE HERE...]

        # 5. Assign a boolean variable is_halfbrick 
        #    based on conditionally checking the criteria for half bricks
        # [ADD YOUR CODE HERE...]

        # 6. Create a new box taking into account that half-bricks need to be half the X size
        # [ADD YOUR CODE HERE...]

        # 7. If it's a half brick...
        # [ADD YOUR CODE HERE...]
            # 8. Move the x coordinate left or right depending on weather it's first or last
            # [ADD YOUR CODE HERE...]

        # 9. Move brick to the correct location
        # [ADD YOUR CODE HERE...]
        
        # 10. Rotate brick based on some logic
        #     For example, calculate the distance from the center point of the brick (x, y, z)
        #     to a reference point (either hard-coded here or referenced adding an input parameter)
        #     Hint: the formula for distance requires using square root, in python `math.sqrt`
        #           and it is as follows:
        #           math.sqrt((x2 - x1)**2 + (y2 - y1)**2 + (z2 - z1)**2)
        # [ADD YOUR CODE HERE...]

        # 11. Append the brick to the output list
        # [ADD YOUR CODE HERE...]
# ---------- end python_3_script_6 ----------

# ----
# Preview
compas_draw_6 = COMPASDraw(cg=python_3_script_6)  # -> rg; same code as compas_draw
preview_6 = CustomPreview(
    Geometry=compas_draw_6,
    Material={diffuse=RGB(197, 130, 64), emission=RGB(68, 53, 68), shine=0.5, specular=RGB(255, 254, 254), transparency=0})

# ---- group: 2. Set file name
# Challenge 02
# Challenge 02
# Double click button
# Challenge 02: ## Challenge 02
# 
# Improve the previous script (either with or without challenge 01) by introducing
# half-bricks at the start and end of every other row. This will create a more
# realistic and structurally sound brick pattern, similar to how bricks are laid
# in typical stretcher bond.
# 
# ### Details
# 
# - Modify your script to include half-bricks at the start or end of every other row.
# - Find a way to differentiate between every other row of bricks to facilitate your placement logic of the half-bricks.
# - Ensure the half-bricks are correctly proportioned, such that the wall ends are flush.
# - Ensure the half-bricks are correctly positioned and aligned with the full bricks, taking into account the staggered pattern.
mustermann_max = Panel("mustermann_max")
assignment_nr = Panel("A01_")

# ---- group: 4. Set display options
toggle = BooleanToggle(False)
toggle_2 = BooleanToggle(False)

# ---- group: 5. Click button to save image
button = Button()

# ---- group: 3. Set image dimensions
width = Panel("3200")
height = Panel("2400")

# ---- group: 1. Select target directory
# Generate a .png image of your current Rhino viewport
path = FilePath()

# ----
python_3_script_7 = Python3Script(
    path=path,
    name=mustermann_max,
    assignment_nr=assignment_nr,
    width=width,
    height=height,
    display_grid=toggle,
    display_grid_axes=toggle_2,
    save=button)  # -> out; inputs path: String, name: String, assignment_nr: String, width: Int32, height: Int32
# ---------- python_3_script_7: Python ----------
import Rhino.Display as rd
import scriptcontext as sc
import System
import os

file_name = name + "_" + assignment_nr

def get_next_index(path):
    index = 1
    while os.path.exists(path + file_name + str(index) + ".png"):
        index += 1
    return index

def ViewCaptureToFile(path):
    view = sc.doc.Views.ActiveView
    if view:
        view_capture = rd.ViewCapture()
        view_capture.TransparentBackground = False
        view_capture.Width = view.ActiveViewport.Size.Width
        view_capture.Height = view.ActiveViewport.Size.Width
        view_capture.ScaleScreenItems = False
        view_capture.DrawAxes = True
        view_capture.DrawGrid = display_grid
        view_capture.DrawGridAxes = display_grid_axes
        size = System.Drawing.Size(view_capture.Width, view_capture.Height)
        size = System.Drawing.Size(width, height)
        
        settings = rd.ViewCaptureSettings(view, size, 72) # view, size, dpi
        settings.RasterMode = True
        settings.DrawGrid = display_grid
        settings.DrawAxis = display_grid_axes
        settings.DrawWallpaper = False
        index = get_next_index(path)
            
        filename = file_name + str(index)
        filename_with_extension = filename + ".png"
        bitmap = rd.ViewCapture.CaptureToBitmap.__overloads__[rd.ViewCaptureSettings](settings)
        fullpath = path + filename_with_extension
        bitmap.Save(fullpath)
        
        return filename_with_extension
        
        
if path is None:
    ghenv.Component.Message = "Please select a target directory first"
else:
    if save:
        path = ViewCaptureToFile(path)
        ghenv.Component.Message = "Saved image to " + path
# ---------- end python_3_script_7 ----------
