# Grasshopper definition akt_agent.gh (Grasshopper 1.0.8)

antikythera_agent = Python3Script(
    task_type="grasshopper.task",
    broker_host="127.0.0.1",
    broker_port="1883",
    enabled=Toggle(True),
    result="some result",
    submit=Button())  # -> out, task_id, inputs, params, output_keys, status; inputs task_type: String, broker_host: String, broker_port: Int32
# ---------- antikythera_agent: Python ----------
# r: compas==2.15.1, compas_eve
# venv: akt_agent
"""Grasshopper Script"""

import threading

import Grasshopper
import scriptcontext as sc

from compas_eve.ghpython import BackgroundWorker


class AKTGHAgentComponent(Grasshopper.Kernel.GH_ScriptInstance):
    def RunScript(self,
            task_type: str,
            broker_host: str,
            broker_port: int,
            enabled,
            result,
            submit):
        broker_host = broker_host or "127.0.0.1"
        broker_port = int(broker_port) if broker_port else 1883
        task_type = task_type or "grasshopper.task"

        # ── Stop ──────────────────────────────────────────────────────────────
        if not enabled:
            BackgroundWorker.stop_instance_by_component(ghenv)  # noqa: F821
            ghenv.Component.Message = "disabled"  # noqa: F821
            return None, None, None, None, "disabled"

        # ── Detect config change → force a fresh worker ───────────────────────
        config = (task_type, broker_host, broker_port)
        config_key = "akt_agent_config_{}".format(ghenv.Component.InstanceGuid)  # noqa: F821

        config_changed = sc.sticky.get(config_key) != config
        sc.sticky[config_key] = config

        # ── Acquire (or restart) the BackgroundWorker ─────────────────────────
        worker = BackgroundWorker.instance_by_component(
            ghenv,  # noqa: F821
            self.run_agent,
            dispose_function=self.stop_agent,
            auto_set_done=False,
            force_new=config_changed,
            args=(task_type, broker_host, broker_port),
        )

        # Start the worker if it is not yet running.
        # (BackgroundWorker itself never auto-starts on instance_by_component.)
        if not worker.is_working() and not worker.is_done():
            worker.start_work()
            ghenv.Component.Message = "starting…"  # noqa: F821
            return None, None, None, None, "starting"

        # ── Submit result ─────────────────────────────────────────────────────
        pending = getattr(worker, "pending_task", None)

        if submit and result is not None and pending:
            outputs = result if isinstance(result, dict) else {(pending["output_keys"][0] if pending["output_keys"] else "result"): result}
            worker.task_result = outputs
            event = getattr(worker, "result_event", None)
            if event:
                event.set()
            worker.pending_task = None
            ghenv.Component.Message = "listening"  # noqa: F821
            return None, None, None, None, "submitted"

        # ── Output current pending task ───────────────────────────────────────
        if pending:
            ghenv.Component.Message = "task received"  # noqa: F821
            return (
                pending["id"],
                pending["inputs"],
                pending["params"],
                pending["output_keys"],
                "task_received",
            )

        ghenv.Component.Message = "listening"  # noqa: F821
        return None, None, None, None, "listening"

    def run_agent(self, worker, task_type, broker_host, broker_port):
        """Called on BackgroundWorker's thread.

        Sets up the AgentLauncher and returns immediately — paho and
        AgentLauncher handle everything else on their own threads.
        auto_set_done=False keeps the worker alive after this returns.
        Any exception here is caught by BackgroundWorker and displayed
        as a component message.
        """
        from antikythera_agents.launcher import AgentLauncher

        # Initialise per-task state on the worker object so RunScript and
        # _GrasshopperAgent.execute_task can share state through it.
        worker.pending_task = None
        worker.result_event = None
        worker.task_result = None

        gh_agent = _GrasshopperAgent(task_type, worker)

        class _GHAgentLauncher(AgentLauncher):
            def _initialize_agents(self_inner):
                pass  # skip plugin auto-discovery

        launcher = _GHAgentLauncher(broker_host, broker_port)
        agent_key = task_type.split(".", 1)[0]
        launcher.agents[agent_key] = gh_agent
        worker.launcher = launcher
        launcher.start()
        worker.display_message("listening")
        # Return immediately; paho network thread + AgentLauncher worker threads
        # are now responsible for all further activity.

    def stop_agent(self, worker):
        """Dispose callback; called by BackgroundWorker.stop_instance_by_component."""
        launcher = getattr(worker, "launcher", None)
        if launcher:
            try:
                launcher.stop()
            except Exception:
                pass
        # Unblock any execute_task thread that is waiting for a GH submission.
        event = getattr(worker, "result_event", None)
        if event:
            event.set()
        worker.display_message("stopped")


import logging
class _GrasshopperAgent:
    """Duck-typed Agent that satisfies the AgentLauncher contract.

    execute_task() is called on a launcher worker thread.  It stores the task
    on the BackgroundWorker and calls worker.update_result() to trigger a GH
    solution re-expiry via compas_ghpython's timer mechanism (the correct way
    to re-solve a GH component from a background thread).  It then blocks
    until RunScript fires the result_event via the submit pulse.
    """

    def __init__(self, task_type, worker):
        self._task_type = task_type
        self._worker = worker
        self._initialized = True
        self.logger = logging.getLogger("GrasshopperAgent")

    def can_claim_task(self, task):
        return task.type == self._task_type and not getattr(self._worker, "pending_task", None)

    def execute_task(self, task, context=None):
        event = threading.Event()
        self._worker.result_event = event
        self._worker.task_result = None
        self._worker.pending_task = {
            "id": task.id,
            "type": task.type,
            "inputs": {i.name: i.value for i in (task.inputs or [])},
            "params": {p.name: p.value for p in (task.params or [])},
            "output_keys": [o.name for o in (task.outputs or [])],
        }

        # update_result stores the task on worker.result AND calls
        # update_component(ghenv, delay) — the compas_ghpython timer-based
        # mechanism that is the correct way to expire a GH solution from a
        # non-UI thread.
        self._worker.update_result(self._worker.pending_task, delay=10)

        # Block until submit is pulsed (or the agent is stopped / cancelled).
        while not event.wait(timeout=0.5):
            if context and context.is_cancelled:
                self._worker.pending_task = None
                raise RuntimeError("Task cancelled by orchestrator")
            if self._worker._is_cancelled:
                raise RuntimeError("GH Agent stopped while waiting for result")

        result = self._worker.task_result
        if result is None:
            raise RuntimeError("GH Agent stopped without providing a result")
        return result

    def dispose(self):
        self._initialized = False

    def list_tools(self):
        return {"execute": "execute_task"}
# ---------- end antikythera_agent ----------
py3 = Python3Script()  # -> out, a
# ---------- py3: Python ----------
# venv: akt_agent
from compas_eve.codecs import ProtobufMessageCodec
from compas_eve.mqtt import MqttTransport
from compas_eve import Publisher
from compas_eve import Subscriber
from compas_eve import Topic


def _get_eve_transport(host, port, codec):
    return MqttTransport(host=host, port=port, codec=codec)

broker_host = "127.0.0.1"
broker_port = 1883

def on_task_start(*args, **kwargs):
    print("on_task_start", *args, **kwargs)

def on_task_allocation(*args, **kwargs):
    print("on_task_allocation", *args, **kwargs)

def on_task_ack(*args, **kwargs):
    print("on_task_ack", *args, **kwargs)

transport = _get_eve_transport(host=broker_host, port=broker_port, codec=ProtobufMessageCodec())
task_start_subscriber = Subscriber(Topic("antikythera/task/start"), on_task_start, transport=transport)
task_allocation_subscriber = Subscriber(Topic("antikythera/task/allocation"), on_task_allocation, transport=transport)
task_completion_publisher = Publisher(Topic("antikythera/task/completed"), transport=transport)
task_claim_publisher = Publisher(Topic("antikythera/task/claim"), transport=transport)
task_ack_subscriber = Subscriber(Topic("antikythera/task/ack"), on_task_ack, transport=transport)

task_start_subscriber.subscribe()
task_allocation_subscriber.subscribe()
task_ack_subscriber.subscribe()
# ---------- end py3 ----------
panel = Panel([antikythera_agent.task_id, antikythera_agent.inputs, antikythera_agent.params, antikythera_agent.output_keys, antikythera_agent.status])
