# Grasshopper definition 00-rf_design_akt.ghx (Grasshopper 1.0.8)
# Copyright: Lorin Wiedemeier

# ----
# Co-Authoring Timber
# CAADRIA 2026
# Brep Meshing
list = ValueList({"Simplest TriRemesh": "stri", "Simplest HexRemesh": "shexa", "TriRemesh": "tri", "QuadRemesh": "quad", "HexaRemesh": "hexa"}, selected="QuadRemesh")
srf = Geometry(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)
py_compas = CompasPyTemplate(mesher_type=list, u_count=Slider(12, range=1..30), v_count=Slider(12, range=1..30), brep=srf, full_faces=Toggle(False))  # -> mesh, goals, geo; inputs mesher_type: String, u_count: Int32, v_count: Int32, brep: Brep
# ---------- py_compas: Python ----------
# r: compas==2.15.1, timber_design==0.2.0, compas_eve
# venv: akt_agent

from compas_rhino.devtools import DevTools
DevTools.ensure_path()
ghenv.Component.Message = "Mesher"

# ------ IMPORTS -------

from compas_rhino.conversions import mesh_to_rhino

from meshers import HexaMesher
from meshers import QuadMesher
from meshers import TriMesher
from meshers import SimplestHexaMesher
from meshers import SimplestTriMesher
from mesh_relax import MeshRelaxerGoals

# --------------------------------------------------
# ------------------- EXECUTION --------------------

if mesher_type == "tri":
    mesher = TriMesher(u_count, v_count, brep)
elif mesher_type == "quad":
    mesher = QuadMesher(u_count, v_count, brep, full_quads = full_faces)
elif mesher_type == "hexa":
    mesher = HexaMesher(u_count, v_count, brep, full_hexas = full_faces)
elif mesher_type == "stri":
    mesher = SimplestTriMesher(u_count, v_count, brep)
elif mesher_type == "shexa":
    mesher = SimplestHexaMesher(u_count, v_count, brep, full_hexas = full_faces)

mesher.generate_mesh()
goals = MeshRelaxerGoals.from_brep(brep)

mesh = mesher.mesh
geo = mesh_to_rhino(mesh, disjoint=False)
# ---------- end py_compas ----------
geometry = Geometry(py_compas.geo)
mesh = Data(py_compas.mesh)
goals = Data(py_compas.goals)

srf_trim = Geometry(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)

# ---- group: Gravitational Point
# Modifiers
pt = Point(Point(2.561481991, 2.115103633, 3.447762801))
py_compas_2 = CompasPyTemplate(attractor_point=pt, attraction_force=Slider(0.02, range=0..1))  # -> modifier; inputs attractor_point: Point3d, attraction_force: Double
# ---------- py_compas_2: Python ----------
# r: compas==2.15.1, timber_design==0.2.0, compas_eve
# venv: akt_agent

from compas_rhino.devtools import DevTools
DevTools.ensure_path()
ghenv.Component.Message = "Attraction Point Modifier"

# ------ IMPORTS -------

from compas_rhino.conversions import point_to_compas

from modifiers import AttractorPointModifier

modifier = AttractorPointModifier(point_to_compas(attractor_point), attraction_force)
# ---------- end py_compas_2 ----------

# ---- group: Directional Force
vec = VectorXYZ(XComponent=Slider(0, range=-1..1), YComponent=Slider(0.07, range=-1..1), ZComponent=Slider(-0.38, range=-1..1))  # -> Vector, Length
py_compas_3 = CompasPyTemplate(direction=vec.Vector, attraction_force=Slider(0.06, range=0..1))  # -> modifier; inputs direction: Vector3d, attraction_force: Double
# ---------- py_compas_3: Python ----------
# r: compas==2.15.1, timber_design==0.2.0, compas_eve
# venv: akt_agent

from compas_rhino.devtools import DevTools
DevTools.ensure_path()
ghenv.Component.Message = "Directional Force"

# ------ IMPORTS -------

from compas_rhino.conversions import point_to_compas
from compas_rhino.conversions import vector_to_compas

from modifiers import DirectionalForce

modifier = DirectionalForce(vector_to_compas(direction), attraction_force)
# ---------- end py_compas_3 ----------

# ---- group: Increse Force Near Borders
py_compas_4 = CompasPyTemplate(strength=Slider(0.06, range=0..1))  # -> modifier; inputs strength: Double
# ---------- py_compas_4: Python ----------
# r: compas==2.15.1, timber_design==0.2.0, compas_eve
# venv: akt_agent

from compas_rhino.devtools import DevTools
DevTools.ensure_path()
ghenv.Component.Message = "Force Around Borders"

# ------ IMPORTS -------

from modifiers import IncreaseForceAroundBorders

# Inputs
strength: float

modifier = IncreaseForceAroundBorders(strength)
# ---------- end py_compas_4 ----------

# ---- group: Border Edge Length
py_compas_5 = CompasPyTemplate(strength=Slider(0.38, range=0..1), ignore_corner_points=Toggle(False))  # -> modifier; inputs strength: Double, ignore_corner_points: Boolean
# ---------- py_compas_5: Python ----------
# r: compas==2.15.1, timber_design==0.2.0, compas_eve
# venv: akt_agent

from compas_rhino.devtools import DevTools
DevTools.ensure_path()
ghenv.Component.Message = "Border Edge Length"

# ------ IMPORTS -------
from modifiers import SameBorderEdgeLength

# Inputs
strength: float
ignore_corner_points: bool

modifier = SameBorderEdgeLength(strength, ignore_corner_points)
# ---------- end py_compas_5 ----------

# ----
py_compas_6 = CompasPyTemplate(target_edge_length=Slider(0.59, range=0..1), K=Slider(0.182, range=0..0.5))  # -> modifier; inputs target_edge_length: Double, K: Double
# ---------- py_compas_6: Python ----------
# r: compas==2.15.1, timber_design==0.2.0, compas_eve
# venv: akt_agent

from compas_rhino.devtools import DevTools
DevTools.ensure_path()
ghenv.Component.Message = "Edge Spring Force"

# ------ IMPORTS -------

from modifiers import TargetEdgeLengthSpringForce

modifier = TargetEdgeLengthSpringForce(target_edge_length, K)
# ---------- end py_compas_6 ----------

# ---- group: Boundary Equalization
py_compas_7 = CompasPyTemplate(K=Slider(0.073, range=0..0.5))  # -> modifier; inputs K: Double
# ---------- py_compas_7: Python ----------
# r: compas==2.15.1, timber_design==0.2.0, compas_eve
# venv: akt_agent

from compas_rhino.devtools import DevTools
DevTools.ensure_path()
ghenv.Component.Message = "Edge Spring Force"

# ------ IMPORTS -------

from modifiers import BoundaryEdgeLengthOptimizer

modifier = BoundaryEdgeLengthOptimizer(None, K)
# ---------- end py_compas_7 ----------

# ---- group: Simplify Border Edge
py_compas_8 = CompasPyTemplate()  # -> modifier
# ---------- py_compas_8: Python ----------
# r: compas==2.15.1, timber_design==0.2.0, compas_eve
# venv: akt_agent

from compas_rhino.devtools import DevTools
DevTools.ensure_path()
ghenv.Component.Message = "Simplify Border Edge"

# ------ IMPORTS -------

from modifiers import SimplifyBorderEdges

modifier = SimplifyBorderEdges()
# ---------- end py_compas_8 ----------

# ---- group: Modifiers
merge = Merge(Data1=py_compas_2)

# ----
modifiers = Data(merge)

# ----
# Mesh Relaxation
mesh_2 = Data(mesh)
goals_2 = Data(goals)
py_compas_9 = CompasPyTemplate(
    mesh=mesh_2,
    damping=Slider(0.15, range=0..0.5),
    goals=goals_2,
    modifiers=modifiers,
    snap_to_surface=Toggle(False),
    reset=Button(),
    on=Toggle(False))  # -> relaxed_mesh, iteration; inputs damping: Double, modifiers: list, snap_to_surface: Boolean, reset: Boolean, on: Boolean
# ---------- py_compas_9: Python ----------
# r: compas==2.15.1, timber_design==0.2.0, compas_eve
# venv: akt_agent

from compas_rhino.devtools import DevTools
DevTools.ensure_path()

# ------ IMPORTS -------

import scriptcontext as sc
import Grasshopper as gh

from compas_ghpython import create_id
from compas_ghpython.timer import update_component

from mesh_relax import MeshRelaxer

# --------------------------------------------------
# ------------------- EXECUTION --------------------

key = create_id(ghenv.Component, "relaxer")

# 1. Initialize or Reset
if reset or key not in sc.sticky:
    relaxer = MeshRelaxer(mesh.copy(), iterations=1)

    sc.sticky[key] = relaxer
    ghenv.Component.Message = "Mesh Relaxer Ready"

# 2. Retrieve state
relaxer = sc.sticky[key]

# 3. Update live parameters
relaxer.damping = damping
relaxer.goals = goals
relaxer.snap_to_surface = snap_to_surface
relaxer.modifiers = modifiers or []

# 4. Run step
if on:
    relaxer.relax()

    ghenv.Component.Message = f"Mesh Relaxer\nIteration #{relaxer.step}"
    update_component(ghenv, 20)

relaxed_mesh = relaxer.mesh
# ---------- end py_compas_9 ----------
dam = DataDam(DataA=py_compas_9.relaxed_mesh, BufferDelay=10000000, BufferMode=0)
draw = COMPASDraw(cg=py_compas_9.relaxed_mesh)  # -> rg
#   port cg: The COMPAS geometry or datastructure to be drawn.
#   port rg: The Rhino geometry object.
# ---------- draw: Python ----------
# r: compas==2.15.1, timber_design==0.2.0, compas_eve
# venv: akt_agent

"""
Draws COMPAS geometry in Grasshopper.
"""

from typing import Any

import Grasshopper

from compas.scene import SceneObject


class CompasToRhinoGeometry(Grasshopper.Kernel.GH_ScriptInstance):
    def RunScript(self, cg):
        if not cg:
            return None

        return SceneObject(item=cg).draw()
# ---------- end draw ----------

mesh_analysis = Data(py_compas_9.relaxed_mesh)
py_compas_10 = CompasPyTemplate(mesh=mesh_analysis, f_index=Slider(27, range=0..100), e_index=Slider(0, range=0..6))  # inputs f_index: Int32, e_index: Int32
# ---------- py_compas_10: Python ----------
# r: compas==2.15.1, timber_design==0.2.0, compas_eve
# venv: akt_agent

"""Grasshopper Script Instance"""
import System
import Rhino
import Rhino.Geometry
import Grasshopper

from compas_rhino.conversions import point_to_rhino

class MyComponent(Grasshopper.Kernel.GH_ScriptInstance):

    def RunScript(self, mesh, f_index: int, e_index: int):
        """
        Inputs:
            mesh: compas.datastructures.Mesh
            f_index: int (Face Index)
            e_index: int (Edge Index)
        """
        ghenv.Component.Message = "Topo Explorer"
        
        # --- Storage for Draw ---
        self._lines = []        
        self._main_labels = []  # Navigation labels (Selected, Next, etc.)
        self._index_labels = [] # Face-local edge indices
        self._global_dots = []  # Global Face and Vertex indices
        
        if not mesh:
            return

        # ------------------------------------------------
        # 0. DRAW ALL MESH EDGES (Background Wireframe)
        # ------------------------------------------------
        wire_color = System.Drawing.Color.FromArgb(180, 180, 180) 
        
        for u, v in mesh.edges():
            p_u = point_to_rhino(mesh.vertex_attributes(u, 'xyz'))
            p_v = point_to_rhino(mesh.vertex_attributes(v, 'xyz'))
            self._lines.append((Rhino.Geometry.Line(p_u, p_v), wire_color, 1))

        # ------------------------------------------------
        # 1. GLOBAL VISUALIZATION 
        # ------------------------------------------------
        for fkey in mesh.faces():
            pt = mesh.face_centroid(fkey)
            self._global_dots.append((str(fkey), point_to_rhino(pt), System.Drawing.Color.Blue, 35))
            
        for vkey in mesh.vertices():
            pt = mesh.vertex_point(vkey)
            self._global_dots.append((str(vkey), point_to_rhino(pt), System.Drawing.Color.Magenta, 30))

        # ------------------------------------------------
        # 2. TOPO NAVIGATION LOGIC
        # ------------------------------------------------
        def get_face_centroid(f_key):
            pts = [mesh.vertex_attributes(v, 'xyz') for v in mesh.face_vertices(f_key)]
            c = [sum(axis)/len(axis) for axis in zip(*pts)]
            return point_to_rhino(c)

        def add_face_indices(f_key, color):
            center = get_face_centroid(f_key)
            vertices = mesh.face_vertices(f_key)
            for i in range(len(vertices)):
                p_u = point_to_rhino(mesh.vertex_attributes(vertices[i], 'xyz'))
                p_v = point_to_rhino(mesh.vertex_attributes(vertices[(i + 1) % len(vertices)], 'xyz'))
                mid = (p_u + p_v) / 2.0
                vec_to_center = center - mid
                text_loc = mid + (vec_to_center * 0.15)
                self._index_labels.append((str(i), text_loc, color, 22))

        if f_index is not None and e_index is not None:
            try:
                f_keys = list(mesh.faces())
                if f_index >= len(f_keys): raise IndexError
                f_key = f_keys[f_index]
                
                f_vtx = mesh.face_vertices(f_key)
                if e_index >= len(f_vtx):
                    self.AddRuntimeMessage(Grasshopper.Kernel.GH_RuntimeMessageLevel.Warning, "Edge Index out of range")
                else:
                    # Highlight active face indices
                    add_face_indices(f_key, System.Drawing.Color.DarkGreen)

                    # --- A. Selected Edge (Black) ---
                    u, v = f_vtx[e_index], f_vtx[(e_index + 1) % len(f_vtx)]
                    p1, p2 = point_to_rhino(mesh.vertex_attributes(u, 'xyz')), point_to_rhino(mesh.vertex_attributes(v, 'xyz'))
                    
                    self._lines.append((Rhino.Geometry.Line(p1, p2), System.Drawing.Color.Black, 6))
                    self._main_labels.append(("*Selected*", (p1+p2)/2, System.Drawing.Color.Black, 24))

                    # --- B. Next Edge (Blue) ---
                    w = f_vtx[(e_index + 2) % len(f_vtx)]
                    p3 = point_to_rhino(mesh.vertex_attributes(w, 'xyz'))
                    
                    self._lines.append((Rhino.Geometry.Line(p2, p3), System.Drawing.Color.DodgerBlue, 4))
                    # Added Label Here:
                    self._main_labels.append(("Next Edge", (p2+p3)/2, System.Drawing.Color.DodgerBlue, 20))
                    
                    # --- C. Previous Edge (Red) ---
                    adj_face = mesh.halfedge_face((v, u))
                    if adj_face is not None:
                        add_face_indices(adj_face, System.Drawing.Color.DarkRed)
                        adj_vtx = mesh.face_vertices(adj_face)
                        if u in adj_vtx:
                            u_idx = adj_vtx.index(u)
                            z = adj_vtx[(u_idx + 1) % len(adj_vtx)]
                            p_z = point_to_rhino(mesh.vertex_attributes(z, 'xyz'))
                            
                            self._lines.append((Rhino.Geometry.Line(p1, p_z), System.Drawing.Color.Red, 4))
                            # Renamed Label Here:
                            self._main_labels.append(("Prev. Edge", (p1+p_z)/2, System.Drawing.Color.Red, 20))
                    else:
                        self._main_labels.append(("Boundary", (p1+p2)/2, System.Drawing.Color.Gray, 18))
            
            except IndexError:
                self.AddRuntimeMessage(Grasshopper.Kernel.GH_RuntimeMessageLevel.Warning, "Face Index out of range")

        return None

    def IsPreviewCapable(self):
        return Grasshopper.Kernel.GH_PreviewCapability.Disabled

    def DrawViewportWires(self, args):
        if hasattr(self, "_lines"):
            for line, color, thickness in self._lines:
                args.Display.DrawLine(line, color, thickness)

    def DrawViewportMeshes(self, args):
        # 1. Global Face/Vertex Indices
        if hasattr(self, "_global_dots"):
            for text, pt, color, size in self._global_dots:
                args.Display.Draw2dText(text, color, pt, True, size)
        
        # 2. Local Edge Indices (0, 1, 2...)
        if hasattr(self, "_index_labels"):
            for text, pt, color, size in self._index_labels:
                args.Display.Draw2dText(text, color, pt, True, size)

        # 3. Navigation Status Labels
        if hasattr(self, "_main_labels"):
            for text, pt, color, size in self._main_labels:
                args.Display.Draw2dText(text, color, pt, True, size)

    def AfterRunScript(self):
        self.MaintainDrawSettings = True
# ---------- end py_compas_10 ----------

# ----
# RF System
compas_mesh = Data(dam)
py_compas_11 = CompasPyTemplate(mesh=compas_mesh, eccentricity=Slider(0.23, range=-1..1), extensions=Slider(0.27, range=-1..1))  # -> rf_system, mesh, centerlines; inputs eccentricity: Double
# ---------- py_compas_11: Python ----------
# r: compas==2.15.1, timber_design==0.2.0, compas_eve
# venv: akt_agent

from compas_rhino.devtools import DevTools
DevTools.ensure_path()
ghenv.Component.Message = "RF Datastracture and lines"

# ------ IMPORTS -------

from rf_system import RFSystem

# --------------------------------------------------
# ------------------- EXECUTION --------------------

rf_system = RFSystem(mesh)

rf_system.create_rf_datastructure()
rf_system.eccentrize_centerlines(eccentricity)
rf_system.extend_centerlines(extensions)

centerlines = rf_system.centerlines
mesh = rf_system.mesh
# ---------- end py_compas_11 ----------
draw_2 = COMPASDraw(cg=py_compas_11.centerlines)  # -> rg
#   port cg: The COMPAS geometry or datastructure to be drawn.
#   port rg: The Rhino geometry object.
# ---------- draw_2: Python ----------
# r: compas==2.15.1, timber_design==0.2.0, compas_eve
# venv: akt_agent

from typing import Any

import Grasshopper

from compas.scene import SceneObject


class CompasToRhinoGeometry(Grasshopper.Kernel.GH_ScriptInstance):
    def RunScript(self, cg):
        if not cg:
            return None

        return SceneObject(item=cg).draw()
# ---------- end draw_2 ----------

# ----
# RF System - Eccentricity w/ Attractor Point
compas_mesh_2 = Data(dam)
pt_2 = Point(Point(-3.606565354, 0.6286702749, 0))
py_compas_12 = CompasPyTemplate(mesh=compas_mesh_2, attractor_point=pt_2, factor=Slider(0.04, range=0..1), extensions=Slider(0.15, range=-1..1))  # -> rf_system, mesh, centerlines; inputs attractor_point: Point3d, extensions: Double
# ---------- py_compas_12: Python ----------
# r: compas==2.15.1, timber_design==0.2.0, compas_eve
# venv: akt_agent

from compas_rhino.devtools import DevTools
DevTools.ensure_path()
ghenv.Component.Message = "RF Datastracture and lines"

# ------ IMPORTS -------

from compas_rhino.conversions import point_to_compas
from rf_system import RFSystem

# --------------------------------------------------
# ------------------- EXECUTION --------------------

attractor_point = point_to_compas(attractor_point)

rf_system = RFSystem(mesh)

rf_system.create_rf_datastructure()
rf_system.eccentrize_centerlines_attractor_point(attractor_point, factor)
rf_system.extend_centerlines(extensions)

centerlines = rf_system.centerlines
mesh = rf_system.mesh
# ---------- end py_compas_12 ----------
draw_3 = COMPASDraw(cg=py_compas_12.centerlines)  # -> rg; same code as draw_2

# ----
# RF System - Eccentricity w/ Attractor Curve
compas_mesh_3 = Data(dam)
geo = Geometry(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)
py_compas_13 = CompasPyTemplate(mesh=compas_mesh_3, attractor_curve=geo, factor=Slider(0.05, range=0..1), extensions=Slider(0.21, range=-1..1))  # -> rf_system, mesh, centerlines; inputs attractor_curve: Curve, extensions: Double
# ---------- py_compas_13: Python ----------
# r: compas==2.15.1, timber_design==0.2.0, compas_eve
# venv: akt_agent

from compas_rhino.devtools import DevTools
DevTools.ensure_path()
ghenv.Component.Message = "RF Datastracture and lines"

# ------ IMPORTS -------

from compas_rhino.conversions import curve_to_compas
from rf_system import RFSystem

# --------------------------------------------------
# ------------------- EXECUTION --------------------

attractor_curve = curve_to_compas(attractor_curve)

rf_system = RFSystem(mesh)

rf_system.create_rf_datastructure()
rf_system.eccentrize_centerlines_attractor_curve(attractor_curve, factor)
rf_system.extend_centerlines(extensions)

centerlines = rf_system.centerlines
mesh = rf_system.mesh
# ---------- end py_compas_13 ----------
draw_4 = COMPASDraw(cg=py_compas_13.centerlines)  # -> rg; same code as draw_2

# ----
# Timber Model
dam_2 = DataDam(DataA=py_compas_11.rf_system, BufferDelay=10000000, BufferMode=0)
py_compas_14 = CompasPyTemplate(
    rf_system=dam_2,
    process_joinery=Toggle(True),
    beam_width=Slider(0.08, range=0..0.2),
    beam_height=Slider(0.1, range=0..0.2),
    tolerance=Slider(0.02, range=0..0.5))  # -> timber_model, beams, joining_errors
# ---------- py_compas_14: Python ----------
# r: compas==2.15.1, timber_design==0.2.0, compas_eve
# venv: akt_agent

from compas_rhino.devtools import DevTools
DevTools.ensure_path()
ghenv.Component.Message = "Timber model"

# -------------------- IMPORTS ---------------------

from timber_model_creator import TimberModelCreator

# ------------------- EXECUTION --------------------

# Copy the RF system on start, because that's the way Grasshopper always behaves
rf_system = rf_system.copy()

# Initialize creator
creator = TimberModelCreator(rf_system, beam_width, beam_height, tolerance=tolerance)

# Create model and apply joints
timber_model = creator.create_timber_model(process_joinery=process_joinery)
joining_errors = creator.joining_errors

if len(joining_errors):
    ghenv.Component.Message = f"Found {len(joining_errors)} joining errors!"

# Output geometry
beams = []
geometry_errors = []
for beam in timber_model.beams:
    try:
        beams.append(beam.geometry)
    except Exception as e:
        geometry_errors.append(e)
        print(f"Could you add geometry of beam: {e}")

if len(geometry_errors) > 0:
    ghenv.Component.Message = f"{len(geometry_errors)} beams failed to generate geometry!"
# ---------- end py_compas_14 ----------
draw_5 = COMPASDraw(cg=py_compas_14.beams)  # -> rg; same code as draw_2
wires = BrepWireframe(Brep=draw_5, Density=-1)
preview = CustomPreview(Geometry=draw_5, Material=ColourSwatch(SwatchColor=RGBA(214, 188, 139, 144)))
preview_2 = CustomPreview(Geometry=wires, Material=ColourSwatch(SwatchColor=RGB(0, 0, 0)))

reloader = CompasDevReloader()
# ---------- reloader: Python ----------
# r: compas==2.15.1, timber_design==0.2.0, compas_eve
# venv: akt_agent

"""
------------------------------
Using VS Code as Python editor
------------------------------

The simplest way to start using VS Code as our editor, is
to place our Python code in files located IN THE SAME FOLDER as our Grasshopper file.

After we have done that, we need 2 steps: 

1. Enable the COMPAS reloader on one component. This tells Grasshopper to watch for changes in the Pythoh files and reload if changed.
2. Every other component that uses Python code from external files needs to start with a method to ensure Grasshopper knows where to load the files from.

"""

from compas_rhino.devtools import DevTools
DevTools.enable_reloader()
# ---------- end reloader ----------
pt_3 = Point(<point referenced from the Rhino model>)

# ----
# Design ready!
# Iterate to submit new design
# (resets fabrication process)
panel = Panel("8c9cea1f6ccb41dc9ca6096badd54de8")
send_model_to_antikythera = Python3Script(enabled=Toggle(True), timber_model=py_compas_14.timber_model, submit=Button())  # -> out, a; inputs task_type: String, broker_host: String, broker_port: Int32
# ---------- send_model_to_antikythera: Python ----------
# r: compas==2.15.1, timber_design==0.2.0, compas_eve
# venv: akt_agent
# env: /Users/chenkasirer/repos/GKR/workshop_caadria_2026/grasshopper/pipeline

"""Design Agent — design.gh

Listens for a 'design.compute' task from the orchestrator.
When a task arrives the component re-solves and exposes any orchestrator
params on the `params` output.  Wire your TimberModel into `timber_model`
and pulse `submit` when you are happy with the design.

The agent sends the model back to the orchestrator which stores it in the
session and forwards it to the Fabrication agent.
"""

import Grasshopper
import scriptcontext as sc

from compas_eve.ghpython import BackgroundWorker
from gh_agent import run_agent, stop_agent

DEFAULT_TASK_TYPE = "design.compute"


class DesignAgentComponent(Grasshopper.Kernel.GH_ScriptInstance):
    def RunScript(self,
            task_type: str,
            broker_host: str,
            broker_port: int,
            enabled,
            timber_model,
            submit):
        broker_host = broker_host or "127.0.0.1"
        broker_port = int(broker_port) if broker_port else 1883
        task_type = task_type or DEFAULT_TASK_TYPE

        # ── Stop ──────────────────────────────────────────────────────────────
        if not enabled:
            BackgroundWorker.stop_instance_by_component(ghenv)  # noqa: F821
            ghenv.Component.Message = "disabled"  # noqa: F821
            return None

        # ── BackgroundWorker ──────────────────────────────────────────────────
        # listetning starts
        worker = BackgroundWorker.instance_by_component(
            ghenv,  # noqa: F821
            lambda w, tt=task_type, bh=broker_host, bp=broker_port: run_agent(
                w, tt, bh, bp, "FabricationAgent"
            ),
            dispose_function=stop_agent,
            auto_set_done=False,
        )

        if not worker.is_working() and not worker.is_done():
            worker.start_work()
            ghenv.Component.Message = "starting…"  # noqa: F821
            return None

        # ── Expose task data ───────────────────────────────────────────────────
        pending_task = getattr(worker, "pending_task", None)

        if submit and pending_task:
            pending_task.task_outputs = {"timber_model": timber_model}
            if pending_task.event:
                pending_task.event.set()

            ghenv.Component.Message = "submitted"  # noqa: F821
            return None

        # if assigned task by antikythera
        if pending_task:
            # we got assigned a task by the orchestrator
            ghenv.Component.Message = "task received — generate toolpaths!"  # noqa: F821
            return None            

        ghenv.Component.Message = "listening"  # noqa: F821
        return None
# ---------- end send_model_to_antikythera ----------
trigger_design_iteration = Python3Script(session_id=panel, iterate=Button())  # -> out, a; inputs session_id: String, api_url: String
# ---------- trigger_design_iteration: Python ----------
# r: compas==2.15.1, timber_design==0.2.0, compas_eve
# venv: akt_agent
# env: /Users/chenkasirer/repos/GKR/workshop_caadria_2026/grasshopper/pipeline
"""Iterate — reset the design task and resume the session.

Place this component in design.gh alongside the Design Agent.
Wire in the ``session_id`` from AKT_Start_Blueprint.
Pulse ``iterate`` after the pipeline has completed (or while running)
to reset the design task and all downstream tasks, then resume.
"""

import json
import urllib.error
import urllib.request

import Grasshopper

BLUEPRINT_ID = "caadria-dfab"
TASK_ID = "design"


class IterateComponent(Grasshopper.Kernel.GH_ScriptInstance):
    def RunScript(self, session_id: str, api_url: str, iterate):
        api_url = api_url or "http://localhost:8000"

        if not iterate:
            return "ready"

        if not session_id:
            ghenv.Component.Message = "no session"  # noqa: F821
            return "error: no session_id"

        ghenv.Component.Message = "iterating..."  # noqa: F821

        # 1. Pause (ignore errors — session may already be stopped/completed)
        _post(api_url, f"/sessions/{session_id}/pause")

        # 2. Reset design task + downstream
        reset = _post(
            api_url,
            f"/sessions/{session_id}/tasks/reset",
            payload={
                "blueprint_id": BLUEPRINT_ID,
                "task_id": TASK_ID,
                "include_downstream": True,
                "clear_outputs": False,
            },
        )
        if "error" in reset:
            ghenv.Component.Message = "reset failed"  # noqa: F821
            return f"error: {reset['error']}"

        # 3. Resume
        start = _post(api_url, f"/sessions/{session_id}/start", payload={})
        if "error" in start:
            ghenv.Component.Message = "start failed"  # noqa: F821
            return f"error: {start['error']}"

        ghenv.Component.Message = "iterated!"  # noqa: F821
        return "iterated"


def _post(api_url, path, payload=None):
    url = f"{api_url.rstrip('/')}{path}"
    data = json.dumps(payload).encode("utf-8") if payload is not None else b"{}"
    req = urllib.request.Request(
        url, data=data, headers={"Content-Type": "application/json"}, method="POST"
    )
    try:
        with urllib.request.urlopen(req) as res:
            return json.loads(res.read().decode("utf-8"))
    except urllib.error.HTTPError as e:
        body = e.read().decode("utf-8", errors="replace")
        return {"error": f"HTTP {e.code}: {body}"}
    except urllib.error.URLError as e:
        return {"error": str(e)}
# ---------- end trigger_design_iteration ----------

sph = Sphere(Base=pt_3, Radius=Slider(0.7, range=0.5..10))
path = FilePath("/Users/chenkasirer/repos/GKR/workshop_caadria_2026/grasshopper/milling_test_beams.json")
fabrication_scope = Python3Script(timber_model=py_compas_14.timber_model, sphere=sph, filepath=path, export=Button())  # -> out, a; inputs sphere: Brep; disabled
# ---------- fabrication_scope: Python ----------
# r: compas==2.15.1, timber_design==0.2.0, compas_eve
# venv: akt_agent

from compas.data import json_dump
from compas.scene import Scene
from compas.geometry import Brep

sphere = Brep.from_native(sphere)

scene = Scene()
beams_processings = []
for beam in timber_model.beams:
    if sphere.contains(beam.centerline.midpoint):
        beams_processings.append({"beam": beam, "processings": beam.features})
        scene.add(beam.geometry)

if beams_processings and filepath and export:
    json_dump(beams_processings, filepath)

a = scene.draw()
# ---------- end fabrication_scope ----------
preview_3 = CustomPreview(Geometry=fabrication_scope.a, Material=ColourSwatch(SwatchColor=RGB(217, 52, 52)))
