# Grasshopper definition 02_operator.ghx (Grasshopper 1.0.8)

# ----
# Antikythera
toggle = BooleanToggle(True)
fabrication_receiver = Python3Script(enabled=toggle)  # -> pending_task; inputs broker_host: String
# ---------- fabrication_receiver: Python ----------
# r: compas==2.15.1, timber_design==0.2.0, compas_eve
# venv: akt_agent

"""Fabrication Receiver — fabrication.gh

Listens for a 'fabrication.toolpaths' task from the orchestrator.
Outputs the TimberModel and task metadata for downstream toolpath generation.

Use the companion Fabrication Submit component to send computed toolpaths
back once they have been reviewed and approved. The two components share the
BackgroundWorker via sc.sticky keyed on task_type to avoid a GH loop.
"""
from compas_rhino.devtools import DevTools
DevTools.ensure_path()

import Grasshopper
import scriptcontext as sc

from compas_eve.ghpython import BackgroundWorker
from gh_agent import run_agent, stop_agent

DEFAULT_TASK_TYPE = "fabrication.toolpaths"


class FabricationReceiverComponent(Grasshopper.Kernel.GH_ScriptInstance):
    def RunScript(self, broker_host: str, enabled):
        print("ran!")
        broker_host = broker_host or "127.0.0.1"
        broker_port = 1883
        task_type = DEFAULT_TASK_TYPE
        # print(sc.sticky)
        # ── Stop ──────────────────────────────────────────────────────────────
        if not enabled:
            BackgroundWorker.stop_instance_by_component(ghenv)  # noqa: F821
            ghenv.Component.Message = "disabled"  # noqa: F821
            return None

        # ── BackgroundWorker ──────────────────────────────────────────────────
        # listetning starts
        worker = BackgroundWorker.instance_by_component(
            ghenv,  # noqa: F821
            lambda w, tt=task_type, bh=broker_host, bp=broker_port: run_agent(
                w, tt, bh, bp, "FabricationAgent"
            ),
            dispose_function=stop_agent,
            auto_set_done=False,
        )

        if not worker.is_working() and not worker.is_done():
            worker.start_work()
            ghenv.Component.Message = "starting…"  # noqa: F821
            return None

        # ── Expose task data ───────────────────────────────────────────────────
        pending_task = getattr(worker, "pending_task", None)

        # if assigned task by antikythera
        if pending_task:
            # we got assigned a task by the orchestrator
            ghenv.Component.Message = "task received — generate toolpaths!"  # noqa: F821
            return pending_task            

        ghenv.Component.Message = "listening"  # noqa: F821
        return None
# ---------- end fabrication_receiver ----------
deconstruct_task = Python3Script(pending_task=fabrication_receiver)  # -> timber_model
# ---------- deconstruct_task: Python ----------
# r: compas==2.15.1, timber_design==0.2.0, compas_eve
# venv: akt_agent
import System
import Rhino
import Grasshopper

import rhinoscriptsyntax as rs

class MyComponent(Grasshopper.Kernel.GH_ScriptInstance):
    def RunScript(self, pending_task):
        timber_model = None
        if pending_task:
            timber_model = pending_task.task_data["inputs"].get("timber_model")
        
        return timber_model
# ---------- end deconstruct_task ----------

# ----
# Doubleclick Me!
number_slider = Slider(27, range=0..100)
beams_from_model = Python3Script(model=deconstruct_task)  # -> beams
# ---------- beams_from_model: Python ----------
beams = None
if model:
    model.process_joinery()
    beams = model.beams
# ---------- end beams_from_model ----------
beam = ListItem(List=beams_from_model, Index=number_slider, Wrap=True)
py3 = Python3Script(model=deconstruct_task)  # -> out, a
# ---------- py3: Python ----------
for beam in model.beams:
    if beam.attributes.get("is_fabed"):
        print("YEA!")
# ---------- end py3 ----------
processings_from_beam = Python3Script(beam=beam)  # -> processing
# ---------- processings_from_beam: Python ----------
if beam:
    processing = beam.features
# ---------- end processings_from_beam ----------
processing = ListItem(List=processings_from_beam, Index=Slider(19, range=0..100), Wrap=True)

# ----
# Tool path
# face 3 => top
toggle_2 = BooleanToggle(True)
list = ValueList({"1": 0, "2": 1, "3": 2, "4": 3}, selected="3")
make_tool_path = Python3Script(
    beam=beam,
    processing=processing,
    enable_rotation=toggle_2,
    machining_side=list,
    tool_radius=Slider(0.009, range=0.001..0.02),
    stepdown=Slider(0.014, range=0.001..0.02),
    stepsize=Slider(0.02, range=0.001..0.02),
    approach_height=Slider(0.6, range=0.1..2))  # -> out, beam_at_origin, volume_at_origin, toolpath, machining_ref_frame, slices, slicing_frames; inputs machining_side: Int32
# ---------- make_tool_path: Python ----------
# r: compas==2.15.1, timber_design==0.2.0, compas_eve
# venv: akt_agent
# env: /Users/chenkasirer/repos/GKR/workshop_caadria_2026/grasshopper/pipeline

from compas_rhino.devtools import DevTools
DevTools.ensure_path()

import math
from compas.geometry import Line
from compas.geometry import Transformation
from compas.geometry import Rotation
from compas_rhino.conversions import frame_to_rhino_plane
from timber_toolpaths import get_toolpath_from_processing

ref_frame = beam.frame.copy()

if enable_rotation:
    rotation_per_refside = {0: 180, 1: 0, 2: 0, 3: 0}
    ref_frame.rotate(math.radians(rotation_per_refside[machining_side]), ref_frame.xaxis, ref_frame.point)

machining_transformation = Transformation.from_frame(ref_frame).inverse()
beam_at_origin = beam.geometry.transformed(machining_transformation)

f = beam.ref_sides[machining_side]
machining_ref_frame = frame_to_rhino_plane(f.transformed(machining_transformation))


# Get toolpaths
print(f"Beam {beam} has {len(beam.features)} features")

results = get_toolpath_from_processing(
    beam,
    processing,  # processing
    machining_transformation,
    tool_radius=tool_radius,
    stepdown=stepdown,
    min_step=stepsize,
    # divisions=20, 
    approach_height=approach_height,
    machining_side=machining_side
)

if results:
    kind, toolpath, volume_at_origin, slices, slicing_frames = results
    toolpath = list(map(frame_to_rhino_plane, toolpath))
    slicing_frames = list(map(frame_to_rhino_plane, slicing_frames))
# ---------- end make_tool_path ----------
item = ListItem(List=make_tool_path.toolpath, Index=Slider(60, range=0..400), Wrap=True)
draw = Python3Script(item=make_tool_path.volume_at_origin)  # -> a
# ---------- draw: Python ----------
# venv: milling_test
from compas.scene import Scene

scene = Scene()
if item:
    scene.add(item)
a = scene.draw()
# ---------- end draw ----------
geo = Geometry(item)

py3_2 = Python3Script(timber_model=deconstruct_task, beam=beam, confirm_ready=Button())  # -> out, mutated_tm
# ---------- py3_2: Python ----------
if timber_model and beam and confirm_ready:
    beam_guid = str(beam.guid)
    beam = timber_model.get_element(beam_guid)
    beam.attributes["is_ready"] = True
mutated_tm = timber_model
# ---------- end py3_2 ----------
fabrication_receiver_2 = Python3Script(pending_task=fabrication_receiver, timber_model=py3_2.mutated_tm, toolpaths=make_tool_path.toolpath, submit=Button())  # -> status; inputs toolpaths: list
# ---------- fabrication_receiver_2: Python ----------
# r: compas==2.15.1, timber_design==0.2.0, compas_eve
# venv: akt_agent

"""Fabrication Submit — fabrication_submit.gh

Companion to the Fabrication Receiver component.
Looks up the shared BackgroundWorker via sc.sticky (keyed on task_type),
accepts the computed toolpaths, and sends them back to the orchestrator
when submit is pulsed.

Wire toolpaths from your downstream toolpath generation logic and pulse
submit to approve and release them to the Robot agent.
"""

import Grasshopper
import scriptcontext as sc

from compas_rhino.conversions import plane_to_compas_frame


DEFAULT_TASK_TYPE = "fabrication.toolpaths"


class FabricationSubmitComponent(Grasshopper.Kernel.GH_ScriptInstance):
    def RunScript(self, pending_task, timber_model, toolpaths: list[object], submit):
        print("ran!")
        print(getattr(pending_task, "event", None))
        if pending_task is None:
            ghenv.Component.Message = "no receiver"  # noqa: F821
            return "no_receiver"
        if submit and pending_task:
            compas_toolpaths = [plane_to_compas_frame(path) for path in toolpaths]
            pending_task.task_outputs = {"toolpaths": toolpaths, "timber_model": timber_model}
            if pending_task.event:
                print("setting event!")
                pending_task.event.set()

            ghenv.Component.Message = "submitted"  # noqa: F821
            return "submitted"

        if pending_task:
            ghenv.Component.Message = "waiting for approval"  # noqa: F821
            return "pending"

        ghenv.Component.Message = "idle"  # noqa: F821
        return "idle"
# ---------- end fabrication_receiver_2 ----------
