# Grasshopper definition 03_operator.ghx (Grasshopper 1.0.8)

# ----
# Antikythera - toolpaths to execute
toggle = BooleanToggle(True)

fabrication_receiver = Python3Script(enabled=toggle)  # -> out, pending_task; inputs broker_host: String
# ---------- fabrication_receiver: Python ----------
# r: compas==2.15.1, timber_design==0.2.0, compas_eve
# venv: akt_agent

"""Fabrication Receiver — fabrication.gh

Listens for a 'fabrication.toolpaths' task from the orchestrator.
Outputs the TimberModel and task metadata for downstream toolpath generation.

Use the companion Fabrication Submit component to send computed toolpaths
back once they have been reviewed and approved. The two components share the
BackgroundWorker via sc.sticky keyed on task_type to avoid a GH loop.
"""
from compas_rhino.devtools import DevTools
DevTools.ensure_path()

import Grasshopper
import scriptcontext as sc

from compas_eve.ghpython import BackgroundWorker
from compas_ghpython import create_id
from gh_agent import run_agent, stop_agent

DEFAULT_TASK_TYPE = "cnc.mill"


def print_sticky():
    for key, value in sc.sticky.items():
        if key.startswith("background"):
            print(f"worker - {value.launcher.launcher_id}")

class FabricationReceiverComponent(Grasshopper.Kernel.GH_ScriptInstance):
    def RunScript(self, broker_host: str, enabled):
        print(create_id(ghenv.Component, "background_worker"))
        broker_host = broker_host or "127.0.0.1"
        broker_port = 1883
        task_type = DEFAULT_TASK_TYPE
        print_sticky()
        # ── Stop ──────────────────────────────────────────────────────────────
        if not enabled:
            BackgroundWorker.stop_instance_by_component(ghenv)  # noqa: F821
            ghenv.Component.Message = "disabled"  # noqa: F821
            return None

        # ── BackgroundWorker ──────────────────────────────────────────────────
        # listetning starts
        worker = BackgroundWorker.instance_by_component(
            ghenv,  # noqa: F821
            lambda w, tt=task_type, bh=broker_host, bp=broker_port: run_agent(
                w, tt, bh, bp, "FabricationAgent"
            ),
            dispose_function=stop_agent,
            auto_set_done=False,
        )

        if not worker.is_working() and not worker.is_done():
            worker.start_work()
            ghenv.Component.Message = "starting…"  # noqa: F821
            return None

        # ── Expose task data ───────────────────────────────────────────────────
        pending_task = getattr(worker, "pending_task", None)

        # if assigned task by antikythera
        if pending_task:
            has_processing = pending_task.task_data["inputs"].get("has_processing")
            if not has_processing:
                if pending_task.event:
                    print("setting event!")
                    pending_task.event.set()
                    ghenv.Component.Message = "no processing!"  # noqa: F821
                    return pending_task

            # we got assigned a task by the orchestrator
            ghenv.Component.Message = "task received — mill!"  # noqa: F821
            return pending_task            

        ghenv.Component.Message = "listening"  # noqa: F821
        return None
# ---------- end fabrication_receiver ----------

deconstruct_task = Python3Script(pending_task=fabrication_receiver.pending_task)  # -> toolpaths
# ---------- deconstruct_task: Python ----------
# r: compas==2.15.1, timber_design==0.2.0, compas_eve
# venv: akt_agent
import System
import Rhino
import Grasshopper

from compas_rhino.conversions import frame_to_rhino_plane

import rhinoscriptsyntax as rs

class MyComponent(Grasshopper.Kernel.GH_ScriptInstance):
    def RunScript(self, pending_task):
        toolpaths = None
        if pending_task:
            toolpaths = pending_task.task_data["inputs"].get("toolpaths")
            if toolpaths:
                toolpaths = [frame_to_rhino_plane(path) for path in toolpaths]
        
        return toolpaths
# ---------- end deconstruct_task ----------

fabrication_receiver_2 = Python3Script(pending_task=fabrication_receiver.pending_task, submit=Button())  # -> status
# ---------- fabrication_receiver_2: Python ----------
# r: compas==2.15.1, timber_design==0.2.0, compas_eve
# venv: akt_agent

"""Fabrication Submit — fabrication_submit.gh

Companion to the Fabrication Receiver component.
Looks up the shared BackgroundWorker via sc.sticky (keyed on task_type),
accepts the computed toolpaths, and sends them back to the orchestrator
when submit is pulsed.

Wire toolpaths from your downstream toolpath generation logic and pulse
submit to approve and release them to the Robot agent.
"""

import Grasshopper
import scriptcontext as sc

from compas_rhino.conversions import plane_to_compas_frame


class FabricationSubmitComponent(Grasshopper.Kernel.GH_ScriptInstance):
    def RunScript(self, pending_task, submit):
        print("ran!")
        print(getattr(pending_task, "event", None))
        if pending_task is None:
            ghenv.Component.Message = "no receiver"  # noqa: F821
            return "no_receiver"
        if submit and pending_task:
            if pending_task.event:
                print("setting event!")
                pending_task.event.set()

            ghenv.Component.Message = "submitted"  # noqa: F821
            return "submitted"

        if pending_task:
            ghenv.Component.Message = "waiting for approval"  # noqa: F821
            return "pending"

        ghenv.Component.Message = "idle"  # noqa: F821
        return "idle"
# ---------- end fabrication_receiver_2 ----------
# To TACO…
geo = Geometry(deconstruct_task)
panel = Panel(deconstruct_task)
