# Grasshopper definition laps_milling_test.gh (Grasshopper 1.0.8)

# ----
# Beam w/ two laps
list = ValueList({"1": 0, "2": 1, "3": 2, "4": 3}, selected="3")
list_2 = ValueList({"1": 0, "2": 1, "3": 2, "4": 3}, selected="1")
first_lap = Python3Script(
    face_index=list,
    start_x=Slider(0.18, range=0..1),
    start_y=Slider(0, range=0..1),
    angle=Slider(82.6, range=0.1..90),
    inclination=Slider(92.3, range=0.1..179.9),
    slope=Slider(0, range=-89.9..89.9),
    length=Slider(0.05, range=0..1),
    width=Slider(0.06, range=0..1),
    depth=Slider(0.03, range=0..1))  # -> lap; inputs face_index: Int32, start_x: Double, start_y: Double, angle: Double, inclination: Double, slope: Double, length: Double, width: Double, depth: Double
# ---------- first_lap: Python ----------
# venv: milling_test
from compas_timber.fabrication import Lap, MachiningLimits

machining_limits = MachiningLimits()
machining_limits.face_limited_front = False

# orientation='start', start_x=0.0, start_y=0.0, angle=90.0, inclination=90.0, slope=0.0, length=200.0, width=50.0, depth=40.0, lead_angle_parallel=True, lead_angle=90.0, lead_inclination_parallel=True, lead_inclination=90.0, machining_limits=None

lap = Lap(
    start_x=start_x, 
    start_y=start_y, 
    angle=angle, 
    inclination=inclination, 
    slope=slope, 
    length=length, 
    width=width, 
    depth=depth,
    ref_side_index=face_index,
    machining_limits=machining_limits
)
# ---------- end first_lap ----------
first_lap_2 = Python3Script(
    face_index=list_2,
    start_x=Slider(0.4, range=0..1),
    start_y=Slider(0, range=0..1),
    angle=Slider(90, range=0.1..90),
    inclination=Slider(90, range=0.1..179.9),
    slope=Slider(0, range=-89.9..89.9),
    length=Slider(0.05, range=0..1),
    width=Slider(0.13, range=0..1),
    depth=Slider(0.01, range=0..1))  # -> lap; inputs face_index: Int32, start_x: Double, start_y: Double, angle: Double, inclination: Double, slope: Double, length: Double, width: Double, depth: Double
# ---------- first_lap_2: Python ----------
# venv: milling_test
from compas_timber.fabrication import Lap

# orientation='start', start_x=0.0, start_y=0.0, angle=90.0, inclination=90.0, slope=0.0, length=200.0, width=50.0, depth=40.0, lead_angle_parallel=True, lead_angle=90.0, lead_inclination_parallel=True, lead_inclination=90.0, machining_limits=None

lap = Lap(
    start_x=start_x, 
    start_y=start_y, 
    angle=angle, 
    inclination=inclination, 
    slope=slope, 
    length=length, 
    width=width, 
    depth=depth,
    ref_side_index=face_index
)
# ---------- end first_lap_2 ----------
create_beam = Python3Script(
    width=Slider(0.05, range=0.01..0.09),
    height=Slider(0.05, range=0.01..0.09),
    length=Slider(0.5, range=0.1..1),
    first_lap=first_lap,
    second_lap=first_lap_2)  # -> beam, processings, geometry; inputs width: Double, height: Double, length: Double
# ---------- create_beam: Python ----------
# r: compas_timber==2.1.1-rc1
# venv: milling_test

from compas.geometry import Frame
from compas.scene import Scene

from compas_timber.elements import Beam
from compas_timber.fabrication import Lap

# Create beam
beam = Beam(Frame.worldXY(), length, width, height)

# Add laps
if first_lap:
    beam.add_features(first_lap)
if second_lap:
    beam.add_features(second_lap)

# Compute and draw geometry
geometry = beam.geometry
# ---------- end create_beam ----------

# ----
# Beams from actual design
panel = Panel("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")
beams_from_file = Python3Script(beams_str=panel, load=Button())  # -> out, beams, a
# ---------- beams_from_file: Python ----------
# venv: milling_test
from compas.geometry import Transformation
from compas.data import json_loads
import scriptcontext as sc
import sys

# cachings beams in sticky so that they are only loaded once
key = "beams_sticky_key"
if load:
    beams_processings = json_loads(beams_str)
    sc.sticky[key] = beams_processings

beams_processings = sc.sticky.get(key)
beams = []
if beams_processings:
    for item in beams_processings:
        beam = item["beam"]

        # adding features mutates the beams and they are saved in sticky, 
        # so reset so stuff doesn't get re-applied
        beam.reset()  

        beam.add_features(item["processings"])
        
        # remove the model's transformation the beams were delivered with
        # this mutates the beams, to revert we need to re-load from file
        beam.transformation = Transformation()
        beams.append(beam)
# ---------- end beams_from_file ----------
item = ListItem(List=beams_from_file.beams, Index=Slider(0, range=0..20), Wrap=True)
show_beam = Python3Script(beam=item)  # -> out, processings, a
# ---------- show_beam: Python ----------
# venv: milling_test
from compas.scene import Scene
from compas_timber.fabrication import DoubleCut

scene = Scene()

processings = []
if beam:
    scene.add(beam.frame)
    scene.add(beam.geometry)

    processings = beam.features
    for f in beam.features:
        print("="*10 + f" {f.PROCESSING_NAME} " + "=" * 10 )
        for key, value in f.params.as_dict().items():
            print(f"{key}: {value}")
        print("="*30)


a = scene.draw()
# ---------- end show_beam ----------
item_2 = ListItem(List=show_beam.processings, Index=Slider(2, range=0..5), Wrap=True)

draw = Python3Script(item=create_beam.geometry)  # -> a
# ---------- draw: Python ----------
# venv: milling_test
from compas.scene import Scene

scene = Scene()
if item:
    scene.add(item)
a = scene.draw()
# ---------- end draw ----------

# ----
# Tool path
# face 3 => top
toggle = BooleanToggle(True)
list_3 = ValueList({"1": 0, "2": 1, "3": 2, "4": 3}, selected="3")
make_tool_path = Python3Script(
    beam=create_beam.beam,
    processing=first_lap,
    enable_rotation=toggle,
    machining_side=list_3,
    tool_radius=Slider(0.009, range=0.001..0.02),
    stepdown=Slider(0.014, range=0.001..0.02),
    stepsize=Slider(0.02, range=0.001..0.02),
    approach_height=Slider(0.6, range=0.1..2))  # -> out, beam_at_origin, volume_at_origin, toolpath, machining_ref_frame, slices, slicing_frames; inputs machining_side: Int32
# ---------- make_tool_path: Python ----------
# venv: milling_test

from compas_rhino.devtools import DevTools
DevTools.ensure_path()

import math
from compas.geometry import Line
from compas.geometry import Transformation
from compas.geometry import Rotation
from compas_rhino.conversions import frame_to_rhino_plane
from timber_toolpaths import get_toolpath_from_processing

ref_frame = beam.frame.copy()

if enable_rotation:
    rotation_per_refside = {0: 180, 1: 0, 2: 0, 3: 0}
    ref_frame.rotate(math.radians(rotation_per_refside[machining_side]), ref_frame.xaxis, ref_frame.point)

machining_transformation = Transformation.from_frame(ref_frame).inverse()
beam_at_origin = beam.geometry.transformed(machining_transformation)

f = beam.ref_sides[machining_side]
machining_ref_frame = frame_to_rhino_plane(f.transformed(machining_transformation))


# Get toolpaths
print(f"Beam {beam} has {len(beam.features)} features")

results = get_toolpath_from_processing(
    beam,
    processing,  # processing
    machining_transformation,
    tool_radius=tool_radius,
    stepdown=stepdown,
    min_step=stepsize,
    # divisions=20, 
    approach_height=approach_height,
    machining_side=machining_side
)

if results:
    kind, toolpath, volume_at_origin, slices, slicing_frames = results
    toolpath = list(map(frame_to_rhino_plane, toolpath))
    slicing_frames = list(map(frame_to_rhino_plane, slicing_frames))
# ---------- end make_tool_path ----------
item_3 = ListItem(List=make_tool_path.toolpath, Index=Slider(60, range=0..400), Wrap=True)
draw_2 = Python3Script(item=make_tool_path.volume_at_origin)  # -> a; same code as draw
geo = Geometry(item_3)
