# Grasshopper definition 00_designer.ghx (Grasshopper 1.0.8)
# Copyright: Lorin Wiedemeier

# ---- group: Gravitational Point
# Modifiers
pt = Point(Point(-0.2085037615, 4.088446067, -0.4620575292))
py_compas = CompasPyTemplate(attractor_point=pt, attraction_force=Slider(0.02, range=0..1))  # -> modifier; inputs attractor_point: Point3d, attraction_force: Double
# ---------- py_compas: Python ----------
# venv: caadria_b01

from compas_rhino.devtools import DevTools
DevTools.ensure_path()
ghenv.Component.Message = "Attraction Point Modifier"

# ------ IMPORTS -------

from compas_rhino.conversions import point_to_compas

from lib_modifiers import AttractorPointModifier

modifier = AttractorPointModifier(point_to_compas(attractor_point), attraction_force)
# ---------- end py_compas ----------

# ---- group: Directional Force
vec = VectorXYZ(XComponent=Slider(0, range=-1..1), YComponent=Slider(0.07, range=-1..1), ZComponent=Slider(-0.38, range=-1..1))  # -> Vector, Length
py_compas_2 = CompasPyTemplate(direction=vec.Vector, attraction_force=Slider(0.06, range=0..1))  # -> modifier; inputs direction: Vector3d, attraction_force: Double
# ---------- py_compas_2: Python ----------
# venv: caadria_b01

from compas_rhino.devtools import DevTools
DevTools.ensure_path()
ghenv.Component.Message = "Directional Force"

# ------ IMPORTS -------

from compas_rhino.conversions import point_to_compas
from compas_rhino.conversions import vector_to_compas

from lib_modifiers import DirectionalForce

modifier = DirectionalForce(vector_to_compas(direction), attraction_force)
# ---------- end py_compas_2 ----------

# ---- group: Increse Force Near Borders
py_compas_3 = CompasPyTemplate(strength=Slider(0.02, range=0..1))  # -> modifier; inputs strength: Double
# ---------- py_compas_3: Python ----------
# venv: caadria_b01

from compas_rhino.devtools import DevTools
DevTools.ensure_path()
ghenv.Component.Message = "Force Around Borders"

# ------ IMPORTS -------

from lib_modifiers import IncreaseForceAroundBorders

# Inputs
strength: float

modifier = IncreaseForceAroundBorders(strength)
# ---------- end py_compas_3 ----------

# ---- group: Border Edge Length
py_compas_4 = CompasPyTemplate(strength=Slider(0.38, range=0..1), ignore_corner_points=Toggle(False))  # -> modifier; inputs strength: Double, ignore_corner_points: Boolean
# ---------- py_compas_4: Python ----------
# venv: caadria_b01

from compas_rhino.devtools import DevTools
DevTools.ensure_path()
ghenv.Component.Message = "Border Edge Length"

# ------ IMPORTS -------
from lib_modifiers import SameBorderEdgeLength

# Inputs
strength: float
ignore_corner_points: bool

modifier = SameBorderEdgeLength(strength, ignore_corner_points)
# ---------- end py_compas_4 ----------

# ----
py_compas_5 = CompasPyTemplate(target_edge_length=Slider(0.59, range=0..1), K=Slider(0.182, range=0..0.5))  # -> modifier; inputs target_edge_length: Double, K: Double
# ---------- py_compas_5: Python ----------
# venv: caadria_b01

from compas_rhino.devtools import DevTools
DevTools.ensure_path()
ghenv.Component.Message = "Edge Spring Force"

# ------ IMPORTS -------

from lib_modifiers import TargetEdgeLengthSpringForce

modifier = TargetEdgeLengthSpringForce(target_edge_length, K)
# ---------- end py_compas_5 ----------

# ---- group: Boundary Equalization
py_compas_6 = CompasPyTemplate(K=Slider(0.073, range=0..0.5))  # -> modifier; inputs K: Double
# ---------- py_compas_6: Python ----------
# venv: caadria_b01

from compas_rhino.devtools import DevTools
DevTools.ensure_path()
ghenv.Component.Message = "Edge Spring Force"

# ------ IMPORTS -------

from lib_modifiers import BoundaryEdgeLengthOptimizer

modifier = BoundaryEdgeLengthOptimizer(None, K)
# ---------- end py_compas_6 ----------

# ----
# RF Design System - GKR
# Gramazio Kohler Research
# Made by: Gonzalo Casas, Lorin Wiedemeier, Eric Gozzi
# Brep Meshing
list = ValueList({"TriRemesh": "tri", "QuadRemesh": "quad", "HexaRemesh": "hexa"}, selected="QuadRemesh")
srf = Geometry(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)
py_compas_7 = CompasPyTemplate(mesher_type=list, u_count=Slider(6, range=1..30), v_count=Slider(6, range=1..30), brep=srf, full_faces=Toggle(False))  # -> mesh, goals, geo; inputs mesher_type: String, u_count: Int32, v_count: Int32, brep: Brep
# ---------- py_compas_7: Python ----------
# venv: caadria_b01

from compas_rhino.devtools import DevTools
DevTools.ensure_path()
ghenv.Component.Message = "Mesher"

# ------ IMPORTS -------
from compas_rhino.conversions import mesh_to_rhino

from lib_mesher import HexaMesher
from lib_mesher import QuadMesher
from lib_mesher import TriMesher
from lib_mesh_relax import MeshRelaxerGoals

# --------------------------------------------------
# ------------------- EXECUTION --------------------

if mesher_type == "tri":
    mesher = TriMesher(u_count, v_count, brep)
elif mesher_type == "quad":
    mesher = QuadMesher(u_count, v_count, brep, full_quads = full_faces)
elif mesher_type == "hexa":
    mesher = HexaMesher(u_count, v_count, brep, full_hexas = full_faces)

mesher.generate_mesh()
goals = MeshRelaxerGoals.from_brep(brep)

mesh = mesher.mesh
geo = mesh_to_rhino(mesh, disjoint=False)
# ---------- end py_compas_7 ----------
geometry = Geometry(py_compas_7.geo)
mesh = Data(py_compas_7.mesh)
goals = Data(py_compas_7.goals)

# ---- group: Fixed boundary Vertices
py_compas_8 = CompasPyTemplate()  # -> modifier
# ---------- py_compas_8: Python ----------
# venv: caadria_b01

from compas_rhino.devtools import DevTools
DevTools.ensure_path()

ghenv.Component.Message = "Fixed Boundary Vertices"

# ------ IMPORTS -------

from compas_rhino.conversions import point_to_compas

from lib_modifiers import FixedBoundaryVertices

modifier = FixedBoundaryVertices()
# ---------- end py_compas_8 ----------

# ---- group: Simplify Border Edge
py_compas_9 = CompasPyTemplate()  # -> modifier
# ---------- py_compas_9: Python ----------
# venv: caadria_b01

from compas_rhino.devtools import DevTools
DevTools.ensure_path()
ghenv.Component.Message = "Simplify Border Edge"

# ------ IMPORTS -------

from lib_modifiers import SimplifyBorderEdges

modifier = SimplifyBorderEdges()
# ---------- end py_compas_9 ----------

# ---- group: Modifiers
merge = Merge(Data1=py_compas, Data6=py_compas_2)

# ----
modifiers = Data(merge)

# ----
# Mesh Relaxation
mesh_2 = Data(mesh)
goals_2 = Data(goals)
py_compas_10 = CompasPyTemplate(
    mesh=mesh_2,
    damping=Slider(0.15, range=0..0.5),
    goals=goals_2,
    modifiers=modifiers,
    snap_to_surface=Toggle(True),
    reset=Button(),
    on=Toggle(False))  # -> relaxed_mesh, iteration; inputs damping: Double, modifiers: list, snap_to_surface: Boolean, reset: Boolean, on: Boolean
# ---------- py_compas_10: Python ----------
# venv: caadria_b01

from compas_rhino.devtools import DevTools
DevTools.ensure_path()

# ------ IMPORTS -------

import scriptcontext as sc
import Grasshopper as gh

from compas_ghpython import create_id
from compas_ghpython.timer import update_component

from lib_mesh_relax import MeshRelaxer

# --------------------------------------------------
# ------------------- EXECUTION --------------------

key = create_id(ghenv.Component, "relaxer")

# 1. Initialize or Reset
if reset or key not in sc.sticky:
    relaxer = MeshRelaxer(mesh.copy(), iterations=1)

    sc.sticky[key] = relaxer
    ghenv.Component.Message = "Mesh Relaxer Ready"

# 2. Retrieve state
relaxer = sc.sticky[key]

# 3. Update live parameters
relaxer.damping = damping
relaxer.goals = goals
relaxer.snap_to_surface = snap_to_surface
relaxer.modifiers = modifiers or []

# 4. Run step
if on:
    relaxer.relax()

    ghenv.Component.Message = f"Mesh Relaxer\nIteration #{relaxer.step}"
    update_component(ghenv, 20)

relaxed_mesh = relaxer.mesh
# ---------- end py_compas_10 ----------
dam = DataDam(DataA=py_compas_10.relaxed_mesh, BufferDelay=10000000, BufferMode=0)
draw = COMPASDraw(cg=py_compas_10.relaxed_mesh)  # -> rg
#   port cg: The COMPAS geometry or datastructure to be drawn.
#   port rg: The Rhino geometry object.
# ---------- draw: Python ----------
# venv: caadria_b01
"""
Draws COMPAS geometry in Grasshopper.
"""

from typing import Any

import Grasshopper

from compas.scene import SceneObject


class CompasToRhinoGeometry(Grasshopper.Kernel.GH_ScriptInstance):
    def RunScript(self, cg):
        if not cg:
            return None

        return SceneObject(item=cg).draw()
# ---------- end draw ----------

mesh_analysis = Data(py_compas_10.relaxed_mesh)
py_compas_11 = CompasPyTemplate(mesh=mesh_analysis, f_index=Slider(27, range=0..100), e_index=Slider(0, range=0..6))  # inputs f_index: Int32, e_index: Int32
# ---------- py_compas_11: Python ----------
# venv: caadria_b01

"""Grasshopper Script Instance"""
import System
import Rhino
import Rhino.Geometry
import Grasshopper

from compas_rhino.conversions import point_to_rhino

class MyComponent(Grasshopper.Kernel.GH_ScriptInstance):

    def RunScript(self, mesh, f_index: int, e_index: int):
        """
        Inputs:
            mesh: compas.datastructures.Mesh
            f_index: int (Face Index)
            e_index: int (Edge Index)
        """
        ghenv.Component.Message = "Topo Explorer"
        
        # --- Storage for Draw ---
        self._lines = []        
        self._main_labels = []  # Navigation labels (Selected, Next, etc.)
        self._index_labels = [] # Face-local edge indices
        self._global_dots = []  # Global Face and Vertex indices
        
        if not mesh:
            return

        # ------------------------------------------------
        # 0. DRAW ALL MESH EDGES (Background Wireframe)
        # ------------------------------------------------
        wire_color = System.Drawing.Color.FromArgb(180, 180, 180) 
        
        for u, v in mesh.edges():
            p_u = point_to_rhino(mesh.vertex_attributes(u, 'xyz'))
            p_v = point_to_rhino(mesh.vertex_attributes(v, 'xyz'))
            self._lines.append((Rhino.Geometry.Line(p_u, p_v), wire_color, 1))

        # ------------------------------------------------
        # 1. GLOBAL VISUALIZATION 
        # ------------------------------------------------
        for fkey in mesh.faces():
            pt = mesh.face_centroid(fkey)
            self._global_dots.append((str(fkey), point_to_rhino(pt), System.Drawing.Color.Blue, 35))
            
        for vkey in mesh.vertices():
            pt = mesh.vertex_point(vkey)
            self._global_dots.append((str(vkey), point_to_rhino(pt), System.Drawing.Color.Magenta, 30))

        # ------------------------------------------------
        # 2. TOPO NAVIGATION LOGIC
        # ------------------------------------------------
        def get_face_centroid(f_key):
            pts = [mesh.vertex_attributes(v, 'xyz') for v in mesh.face_vertices(f_key)]
            c = [sum(axis)/len(axis) for axis in zip(*pts)]
            return point_to_rhino(c)

        def add_face_indices(f_key, color):
            center = get_face_centroid(f_key)
            vertices = mesh.face_vertices(f_key)
            for i in range(len(vertices)):
                p_u = point_to_rhino(mesh.vertex_attributes(vertices[i], 'xyz'))
                p_v = point_to_rhino(mesh.vertex_attributes(vertices[(i + 1) % len(vertices)], 'xyz'))
                mid = (p_u + p_v) / 2.0
                vec_to_center = center - mid
                text_loc = mid + (vec_to_center * 0.15)
                self._index_labels.append((str(i), text_loc, color, 22))

        if f_index is not None and e_index is not None:
            try:
                f_keys = list(mesh.faces())
                if f_index >= len(f_keys): raise IndexError
                f_key = f_keys[f_index]
                
                f_vtx = mesh.face_vertices(f_key)
                if e_index >= len(f_vtx):
                    self.AddRuntimeMessage(Grasshopper.Kernel.GH_RuntimeMessageLevel.Warning, "Edge Index out of range")
                else:
                    # Highlight active face indices
                    add_face_indices(f_key, System.Drawing.Color.DarkGreen)

                    # --- A. Selected Edge (Black) ---
                    u, v = f_vtx[e_index], f_vtx[(e_index + 1) % len(f_vtx)]
                    p1, p2 = point_to_rhino(mesh.vertex_attributes(u, 'xyz')), point_to_rhino(mesh.vertex_attributes(v, 'xyz'))
                    
                    self._lines.append((Rhino.Geometry.Line(p1, p2), System.Drawing.Color.Black, 6))
                    self._main_labels.append(("*Selected*", (p1+p2)/2, System.Drawing.Color.Black, 24))

                    # --- B. Next Edge (Blue) ---
                    w = f_vtx[(e_index + 2) % len(f_vtx)]
                    p3 = point_to_rhino(mesh.vertex_attributes(w, 'xyz'))
                    
                    self._lines.append((Rhino.Geometry.Line(p2, p3), System.Drawing.Color.DodgerBlue, 4))
                    # Added Label Here:
                    self._main_labels.append(("Next Edge", (p2+p3)/2, System.Drawing.Color.DodgerBlue, 20))
                    
                    # --- C. Previous Edge (Red) ---
                    adj_face = mesh.halfedge_face((v, u))
                    if adj_face is not None:
                        add_face_indices(adj_face, System.Drawing.Color.DarkRed)
                        adj_vtx = mesh.face_vertices(adj_face)
                        if u in adj_vtx:
                            u_idx = adj_vtx.index(u)
                            z = adj_vtx[(u_idx + 1) % len(adj_vtx)]
                            p_z = point_to_rhino(mesh.vertex_attributes(z, 'xyz'))
                            
                            self._lines.append((Rhino.Geometry.Line(p1, p_z), System.Drawing.Color.Red, 4))
                            # Renamed Label Here:
                            self._main_labels.append(("Prev. Edge", (p1+p_z)/2, System.Drawing.Color.Red, 20))
                    else:
                        self._main_labels.append(("Boundary", (p1+p2)/2, System.Drawing.Color.Gray, 18))
            
            except IndexError:
                self.AddRuntimeMessage(Grasshopper.Kernel.GH_RuntimeMessageLevel.Warning, "Face Index out of range")

        return None

    def IsPreviewCapable(self):
        return Grasshopper.Kernel.GH_PreviewCapability.Disabled

    def DrawViewportWires(self, args):
        if hasattr(self, "_lines"):
            for line, color, thickness in self._lines:
                args.Display.DrawLine(line, color, thickness)

    def DrawViewportMeshes(self, args):
        # 1. Global Face/Vertex Indices
        if hasattr(self, "_global_dots"):
            for text, pt, color, size in self._global_dots:
                args.Display.Draw2dText(text, color, pt, True, size)
        
        # 2. Local Edge Indices (0, 1, 2...)
        if hasattr(self, "_index_labels"):
            for text, pt, color, size in self._index_labels:
                args.Display.Draw2dText(text, color, pt, True, size)

        # 3. Navigation Status Labels
        if hasattr(self, "_main_labels"):
            for text, pt, color, size in self._main_labels:
                args.Display.Draw2dText(text, color, pt, True, size)

    def AfterRunScript(self):
        self.MaintainDrawSettings = True
# ---------- end py_compas_11 ----------

# ----
# RF System
compas_mesh = Data(dam)
py_compas_12 = CompasPyTemplate(mesh=compas_mesh, eccentricity=Slider(0.048, range=-1..1), extensions=Slider(0.04, range=-1..1))  # -> rf_system, mesh, centerlines; inputs eccentricity: Double
# ---------- py_compas_12: Python ----------
# venv: caadria_b01

from compas_rhino.devtools import DevTools
DevTools.ensure_path()
ghenv.Component.Message = "RF Datastracture and lines"

# ------ IMPORTS -------

from lib_rf_system import RFSystem

# --------------------------------------------------
# ------------------- EXECUTION --------------------

rf_system = RFSystem(mesh)

rf_system.create_rf_datastructure()
rf_system.eccentrize_centerlines(eccentricity)
rf_system.extend_centerlines(extensions)

centerlines = rf_system.centerlines
mesh = rf_system.mesh
# ---------- end py_compas_12 ----------
draw_2 = COMPASDraw(cg=py_compas_12.centerlines)  # -> rg
#   port cg: The COMPAS geometry or datastructure to be drawn.
#   port rg: The Rhino geometry object.
# ---------- draw_2: Python ----------
# venv: caadria_b01

from typing import Any

import Grasshopper

from compas.scene import SceneObject


class CompasToRhinoGeometry(Grasshopper.Kernel.GH_ScriptInstance):
    def RunScript(self, cg):
        if not cg:
            return None

        return SceneObject(item=cg).draw()
# ---------- end draw_2 ----------

# ----
# RF System - Eccentricity w/ Attractor Point
compas_mesh_2 = Data(dam)
pt_2 = Point(Point(-3.606565354, 0.6286702749, 0))
py_compas_13 = CompasPyTemplate(mesh=compas_mesh_2, attractor_point=pt_2, factor=Slider(0.04, range=0..1), extensions=Slider(0.15, range=-1..1))  # -> rf_system, mesh, centerlines; inputs attractor_point: Point3d, extensions: Double
# ---------- py_compas_13: Python ----------
# venv: caadria_b01

from compas_rhino.devtools import DevTools
DevTools.ensure_path()
ghenv.Component.Message = "RF Datastracture and lines"

# ------ IMPORTS -------

from compas_rhino.conversions import point_to_compas
from lib_rf_system import RFSystem

# --------------------------------------------------
# ------------------- EXECUTION --------------------

attractor_point = point_to_compas(attractor_point)

rf_system = RFSystem(mesh)

rf_system.create_rf_datastructure()
rf_system.eccentrize_centerlines_attractor_point(attractor_point, factor)
rf_system.extend_centerlines(extensions)

centerlines = rf_system.centerlines
mesh = rf_system.mesh
# ---------- end py_compas_13 ----------
draw_3 = COMPASDraw(cg=py_compas_13.centerlines)  # -> rg; same code as draw_2

# ----
# RF System - Eccentricity w/ Attractor Curve
compas_mesh_3 = Data(dam)
geo = Geometry(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)
py_compas_14 = CompasPyTemplate(mesh=compas_mesh_3, attractor_curve=geo, factor=Slider(0.05, range=0..1), extensions=Slider(0.21, range=-1..1))  # -> rf_system, mesh, centerlines; inputs attractor_curve: Curve, extensions: Double
# ---------- py_compas_14: Python ----------
# venv: caadria_b01

from compas_rhino.devtools import DevTools
DevTools.ensure_path()
ghenv.Component.Message = "RF Datastracture and lines"

# ------ IMPORTS -------

from compas_rhino.conversions import curve_to_compas
from lib_rf_system import RFSystem

# --------------------------------------------------
# ------------------- EXECUTION --------------------

attractor_curve = curve_to_compas(attractor_curve)

rf_system = RFSystem(mesh)

rf_system.create_rf_datastructure()
rf_system.eccentrize_centerlines_attractor_curve(attractor_curve, factor)
rf_system.extend_centerlines(extensions)

centerlines = rf_system.centerlines
mesh = rf_system.mesh
# ---------- end py_compas_14 ----------
draw_4 = COMPASDraw(cg=py_compas_14.centerlines)  # -> rg; same code as draw_2

# ----
# Adjust Centerlines - Bouncy
number_slider = Slider(0.17, range=0..0.5)
goals_3 = Data(goals)
py_compas_15 = CompasPyTemplate(
    rf_system=py_compas_12.rf_system,
    damping=number_slider,
    goals=goals_3,
    snap_to_surface=Toggle(True),
    reset=Button(),
    on=Toggle(False))  # -> rf_system, iteration, centerlines; inputs damping: Double, snap_to_surface: Boolean, reset: Boolean
# ---------- py_compas_15: Python ----------
# venv: caadria_b01

from compas_rhino.devtools import DevTools
DevTools.ensure_path()

# ------ IMPORTS -------


import scriptcontext as sc

from compas_ghpython import create_id
from compas_ghpython.timer import update_component

# --------------------------------------------------
# ------------------- EXECUTION --------------------

key = create_id(ghenv.Component, "adjusted_rf_system")

# 1. Initialize or Reset
if reset or key not in sc.sticky:
    adjusted_rf_system = rf_system.copy()
    adjusted_rf_system.mesh.attributes["step"] = 0
    sc.sticky[key] = adjusted_rf_system
    ghenv.Component.Message = "Ready"

# 2. Retrieve state
adjusted_rf_system = sc.sticky[key]

# 3. Run step
if on:
    adjusted_rf_system.compute_spring_forces(damping)
    adjusted_rf_system.apply_spring_forces()
    if snap_to_surface:
        adjusted_rf_system.snap_centerlines_to_surface(goals)
    iteration  = adjusted_rf_system.mesh.attributes["step"]
    adjusted_rf_system.mesh.attributes["step"] += 1

    ghenv.Component.Message = f"Spring Adjustment\nIteration #{iteration}"
    update_component(ghenv, 20)

rf_system = adjusted_rf_system
centerlines = rf_system.centerlines
# ---------- end py_compas_15 ----------
dam_2 = DataDam(DataA=py_compas_15.rf_system, BufferDelay=10000000, BufferMode=0)
draw_5 = COMPASDraw(cg=py_compas_15.centerlines)  # -> rg
#   port cg: The COMPAS geometry or datastructure to be drawn.
#   port rg: The Rhino geometry object.
# ---------- draw_5: Python ----------
# venv: caadria_b01

"""
Draws COMPAS geometry in Grasshopper.
"""

from typing import Any

import Grasshopper

from compas.scene import SceneObject


class CompasToRhinoGeometry(Grasshopper.Kernel.GH_ScriptInstance):
    def RunScript(self, cg):
        if not cg:
            return None

        return SceneObject(item=cg).draw()
# ---------- end draw_5 ----------

# ----
# Extend Centerlines
number_slider_2 = Slider(0.04, range=-1..1)
py_compas_16 = CompasPyTemplate(rf_system=dam_2, extension=number_slider_2)  # -> rf_system, centerlines; inputs extension: Double
# ---------- py_compas_16: Python ----------
# venv: caadria_b01

rf_system = rf_system.copy()

rf_system.extend_centerlines(extension)
centerlines = rf_system.centerlines
# ---------- end py_compas_16 ----------
draw_6 = COMPASDraw(cg=py_compas_16.centerlines)  # -> rg; same code as draw

# ----
# Live Edit Centerlines
rf_system = Data(py_compas_16.rf_system)
goals_4 = Data(goals)
py_compas_17 = CompasPyTemplate(rf_system=rf_system)  # -> lines
# ---------- py_compas_17: Python ----------
# venv: caadria_b01

from compas_rhino.conversions import line_to_rhino
lines = [line_to_rhino(c_lines) for c_lines in rf_system.centerlines]
# ---------- end py_compas_17 ----------
py_compas_18 = CompasPyTemplate(goals=goals_4)  # -> target_surface
# ---------- py_compas_18: Python ----------
# venv: caadria_b01

from compas_rhino.conversions import surface_to_rhino
target_surface = surface_to_rhino(goals.target_surface)
# ---------- end py_compas_18 ----------
active = BooleanToggle(False)
undo = Button()
live_edit_geometry = CSharpScript(
    lines=py_compas_17,
    reset=Button(),
    active=active,
    tol="50",
    gumball=Toggle(True),
    snap_geom=Toggle(True),
    snap_ext=Toggle(False),
    snap_srf=Toggle(True),
    undo=undo,
    srf=py_compas_18)  # -> out_lines, points; inputs lines: list of Line, reset: Boolean, active: Boolean, tol: Int32, gumball: Boolean, snap_geom: Boolean, snap_ext: Boolean, snap_srf: Boolean, undo: Boolean, srf: Brep
# ---------- live_edit_geometry: C# ----------
using System;
using System.Collections;
using System.Collections.Generic;

using Rhino;
using Rhino.Geometry;

using Grasshopper;
using Grasshopper.Kernel;
using Grasshopper.Kernel.Data;
using Grasshopper.Kernel.Types;

// ------------------------------------------------------------------------------
// C# SCRIPT FOR GRASSHOPPER
// Copy the content below into a C# Script Component
// ------------------------------------------------------------------------------

/* 
 * INPUTS (Rename your Component inputs to match these!):
 * lines     : List<Line>  (List Access)
 * reset     : bool        (Item Access)
 * active    : bool        (Item Access)
 * tol       : int         (Item Access)
 * gumball   : bool        (Item Access)
 * snap_geom : bool        (Item Access)
 * snap_ext  : bool        (Item Access) * snap_ext  : bool        (Item Access) * snap_srf  : bool        (Item Access)
 * srf       : Brep        (Item Access)
 * undo      : bool        (Item Access)
 *
 * OUTPUTS (Rename your Component outputs to match these!):
 * out_lines : List of modified lines
 * points    : List of points
 */


// TODOs / Improvements:
// - snap to grid?
// - snap to ortho (shift key?)
// - store movements: undo-redo stack, but also re-apply movements after reset (triggerd by input button)

public class Script_Instance : GH_ScriptInstance
{
  private void RunScript(
		List<Line> lines,
		bool reset,
		bool active,
		int tol,
		bool gumball,
		bool snap_geom,
		bool snap_ext,
		bool snap_srf,
		bool undo,
		Brep srf,
		ref object out_lines,
		ref object points)
  {
    // 1. Initialize Controller
    if (_controller == null)
    {
      _controller = new InteractionController(this.Component);
    }

    // 2. Handle Reset
    if (reset || _controller.Points == null || _controller.Points.Count == 0)
    {
      _controller.SetPointsFromLines(lines);
      _controller.ClearUndo(); 
    }
    else if (undo)
    {
       _controller.Undo();
    }
    
    if (lines == null || lines.Count == 0) return;

    // 3. Update behavior
    _controller.Enabled = active;
    _controller.Tolerance = (tol > 0) ? tol : 30; 
    _controller.SnapToGeometry = snap_geom;
    _controller.SnapToExtension = snap_ext;
    _controller.SnapToSurface = snap_srf;
    _controller.TargetSurface = srf;
    _controller.UseGumball = gumball;

    // 4. Output
    if (_controller.Points != null)
    {
      points = new List<Point3d>(_controller.Points);
      out_lines = _controller.ReconstructLines();
    }
  }

  private InteractionController _controller;

  // <Custom additional code> 
  
  public class InteractionController : IDisposable
  {
    public List<Point3d> Points { get; private set; }
    public bool Enabled 
    {
      get { return _enabled; }
      set 
      {
        if (_enabled == value) return;
        _enabled = value;
        if (_enabled) Enable();
        else Disable();
      }
    }
    public int Tolerance { get; set; } = 30; // 30px
    public bool SnapToGeometry { get; set; } = false;
    public bool SnapToExtension { get; set; } = false;
    public bool SnapToSurface { get; set; } = false;
    public Brep TargetSurface { get; set; }
    public bool UseGumball { get; set; } = false;

    private bool _enabled = false;
    private IGH_Component _component;
    private EditorConduit _conduit;
    private EditorMouseCallback _mouseCallback;

    public int DragIndex = -1;
    public int HoverIndex = -1;
    public Plane DragPlane;
    public Point3d DragOrigin; // Original point location when drag started
    public Vector3d ConstraintAxis = Vector3d.Unset; // For Gumball
    public Vector3d HoverAxis = Vector3d.Unset; // For Gumball Highlight
    
    // Line Extension Constraint
    public Line ExtensionLine; 
    public bool IsExtensionConstrained = false;

    // TOGGLE: Determines if Line Extension prevents other snaps (True) or if other snaps override it (False)
    public bool ExtensionOverridesSnaps = true; 

    // TOGGLE: Determines if Gumball Axis Movement overrides all snaps (True)
    public bool AxisMoveOverrideSnaps = true;

    // Snap Feedback
    public Point3d CurrentSnapPoint = Point3d.Unset;
    public bool IsSnapped = false;

    // UNDO Stack
    private Stack<List<Point3d>> _undoStack = new Stack<List<Point3d>>();

    public InteractionController(IGH_Component component)
    {
      _component = component;
      Points = new List<Point3d>();
    }

    public void RecordUndo()
    {
        if (Points != null)
        {
            // Deep copy of points
            List<Point3d> state = new List<Point3d>(Points);
            _undoStack.Push(state);
            
            // Limit stack depth if needed
            if (_undoStack.Count > 50) 
            {
               // Stack doesn't have RemoveLast, but for now 50 is plenty
            }
        }
    }

    public void Undo()
    {
        if (_undoStack.Count > 0)
        {
            List<Point3d> prevParams = _undoStack.Pop();
            Points = prevParams;
            if (_component != null) _component.ExpireSolution(true);
        }
    }
    
    public void ClearUndo()
    {
        _undoStack.Clear();
    }

    public void SetPointsFromLines(List<Line> lines)
    {
      Points.Clear();
      if (lines == null) return;
      foreach (Line ln in lines)
      {
        Points.Add(ln.From);
        Points.Add(ln.To);
      }
    }

    public List<Line> ReconstructLines()
    {
      var result = new List<Line>();
      if (Points == null) return result;
      for (int i = 0; i < Points.Count - 1; i += 2)
      {
        result.Add(new Line(Points[i], Points[i + 1]));
      }
      return result;
    }

    private void Enable()
    {
      Disable(); 
      _conduit = new EditorConduit(this);
      _conduit.Enabled = true;

      _mouseCallback = new EditorMouseCallback(this, _component);
      _mouseCallback.Enabled = true;
    }

    private void Disable()
    {
      if (_conduit != null) { _conduit.Enabled = false; _conduit = null; }
      if (_mouseCallback != null) { _mouseCallback.Enabled = false; _mouseCallback = null; }
      
      if (Rhino.RhinoDoc.ActiveDoc != null)
        Rhino.RhinoDoc.ActiveDoc.Views.Redraw();
    }

    public void Dispose()
    {
      Disable();
    }
  }

  public class EditorConduit : Rhino.Display.DisplayConduit
  {
    private InteractionController _controller;
    private System.Drawing.Color _cDef = System.Drawing.Color.Black;
    private System.Drawing.Color _cHover = System.Drawing.Color.Red;
    private System.Drawing.Color _cDrag = System.Drawing.Color.Blue;
    private System.Drawing.Color _cSnap = System.Drawing.Color.Fuchsia;

    public EditorConduit(InteractionController controller)
    {
      _controller = controller;
    }

    protected override void CalculateBoundingBox(Rhino.Display.CalculateBoundingBoxEventArgs e)
    {
      if (_controller != null && _controller.Enabled && _controller.Points != null)
      {
        var bbox = new BoundingBox(_controller.Points);
        e.IncludeBoundingBox(bbox);
      }
    }

    protected override void DrawOverlay(Rhino.Display.DrawEventArgs e)
    {
      if (_controller == null || !_controller.Enabled || _controller.Points == null) return;

      var pts = _controller.Points;

      // Draw Lines
      for (int i = 0; i < pts.Count - 1; i += 2)
      {
          e.Display.DrawLine(pts[i], pts[i + 1], System.Drawing.Color.Black, 2);
      }

      // Draw Points
      for (int i = 0; i < pts.Count; i++)
      {
        var radius = 4;
        var color = _cDef;
        var style = Rhino.Display.PointStyle.RoundControlPoint;

        if (i == _controller.DragIndex)
        {
          color = _cDrag;
          radius = 6;
        }
        else if (i == _controller.HoverIndex)
        {
          color = _cHover;
          radius = 5; 
        }

        e.Display.DrawPoint(pts[i], style, radius, color);
      }

      // Draw Snapping Confirmation
      if (_controller.DragIndex != -1 && _controller.IsSnapped)
      {
          e.Display.DrawPoint(_controller.CurrentSnapPoint, Rhino.Display.PointStyle.X, 8, _cSnap);
          // Optional: Draw Line from Mouse to Snap
      }

      // Draw "Gumball" (Simple Arrows)
      // Show when Dragging or Hovering
      int gumballIndex = -1;
      if (_controller.DragIndex != -1) gumballIndex = _controller.DragIndex;
      else if (_controller.HoverIndex != -1) gumballIndex = _controller.HoverIndex;

      if (_controller.UseGumball && gumballIndex != -1)
      {
         Point3d origin = pts[gumballIndex];
         
         // Use camera oriented scale or fixed world scale? 
         // Fixed world scale is easier, lets guess 1.0 or based on tolerance?
         double scale = 1.0; 
         // Better: Use pixels to world scale
         try {
             double pixelsPerUnit;
             e.Viewport.GetWorldToScreenScale(origin, out pixelsPerUnit);
             if (pixelsPerUnit > 0) scale = 80.0 / pixelsPerUnit; // 80 pixels long
         } catch {}

         // Hide thick highlights when dragging to keep view clean
         bool showHighlights = (_controller.DragIndex == -1);

         // X Axis (Red)
         if (showHighlights && _controller.HoverAxis == Vector3d.XAxis) e.Display.DrawLine(new Line(origin, origin + Vector3d.XAxis * scale), System.Drawing.Color.Gold, 5); // Highlight
         e.Display.DrawArrow(new Line(origin, origin + Vector3d.XAxis * scale), System.Drawing.Color.Red, 3, 0.3);
         
         // Y Axis (Green)
         if (showHighlights && _controller.HoverAxis == Vector3d.YAxis) e.Display.DrawLine(new Line(origin, origin + Vector3d.YAxis * scale), System.Drawing.Color.Gold, 5);
         e.Display.DrawArrow(new Line(origin, origin + Vector3d.YAxis * scale), System.Drawing.Color.FromArgb(0, 200, 0), 3, 0.3);
         
         // Z Axis (Blue)
         if (showHighlights && _controller.HoverAxis == Vector3d.ZAxis) e.Display.DrawLine(new Line(origin, origin + Vector3d.ZAxis * scale), System.Drawing.Color.Gold, 5);
         e.Display.DrawArrow(new Line(origin, origin + Vector3d.ZAxis * scale), System.Drawing.Color.Blue, 3, 0.3);
         
         // Highlight constrained axis
         if (_controller.DragIndex != -1 && _controller.ConstraintAxis != Vector3d.Unset)
         {
             // Draw "infinite" line but controlled length to avoid glitches
             Point3d basePt = (_controller.Enabled) ? _controller.DragOrigin : origin;

             // Length: approx 60 * 80px = 4800px on screen
             double ext = scale * 60.0; 
             
             Line axisLine = new Line(
                 basePt - _controller.ConstraintAxis * ext, 
                 basePt + _controller.ConstraintAxis * ext
             );
             
             // Use standard line, LightGray for subtlety
             e.Display.DrawLine(axisLine, System.Drawing.Color.LightGray, 1);
         }
      }

      // Draw Extension Constraint Line (Inference)
      if (_controller.DragIndex != -1 && _controller.IsExtensionConstrained && _controller.ConstraintAxis == Vector3d.Unset)
      {
           // Calculate scale for length
           double scale = 1.0; 
           try {
               double pixelsPerUnit;
               Point3d mid = _controller.ExtensionLine.From;
               e.Viewport.GetWorldToScreenScale(mid, out pixelsPerUnit);
               if (pixelsPerUnit > 0) scale = 80.0 / pixelsPerUnit; 
           } catch {}

           double ext = scale * 60.0;
           Vector3d dir = _controller.ExtensionLine.Direction;
           dir.Unitize();
           
           // Draw line passing through fixed point (From)
           Point3d fixedPt = _controller.ExtensionLine.From;
           Line visLine = new Line(fixedPt - dir * ext, fixedPt + dir * ext);
           
           // Draw dashed or light gray
           e.Display.DrawLine(visLine, System.Drawing.Color.LightGray, 1);
      }
    }
  }

  public class EditorMouseCallback : Rhino.UI.MouseCallback
  {
    private InteractionController _controller;
    private IGH_Component _component;

    public EditorMouseCallback(InteractionController controller, IGH_Component component)
    {
      _controller = controller;
      _component = component;
    }

    protected override void OnMouseDown(Rhino.UI.MouseCallbackEventArgs e)
    {
      if (_component.OnPingDocument() == null) { this.Enabled = false; return; }

      if (e.Button == System.Windows.Forms.MouseButtons.Left)
      {
        if (_controller.HoverIndex != -1)
        {
          // RECORD STATE BEFORE DRAG BEGINS
          _controller.RecordUndo();

          _controller.DragIndex = _controller.HoverIndex;

          var view = e.View.ActiveViewport;
          var pt = _controller.Points[_controller.DragIndex];
          _controller.DragOrigin = pt; // Store start position for Gumball
          
          // GUMBALL DETECTION (Using pre-calculated HoverAxis)
          _controller.ConstraintAxis = Vector3d.Unset;
          if (_controller.UseGumball && _controller.HoverAxis != Vector3d.Unset)
          {
             _controller.ConstraintAxis = _controller.HoverAxis;
          }

          // Robust Plane creation
          Plane plane;
          if (_controller.ConstraintAxis != Vector3d.Unset)
          {
             // If Constrained, plane doesn't matter as much, but we need one for intersection
             // Create plane calculating "look"
             view.GetCameraFrame(out plane); 
             plane.Origin = pt;
          }
          else
          {
              view.GetCameraFrame(out plane); 
              plane.Origin = pt;
          }
          _controller.DragPlane = plane;

          e.View.Redraw();
          e.Cancel = true; 
        }
      }
      base.OnMouseDown(e);
    }

    // Helper: Min distance between two skew lines (finite segments check approximates)
    private double DistLineLine(Line ray, Line axis)
    {
       double a, b;
       // IntersectLib version handles infinite lines, we need to be careful
       // For Gumball, approximate check: closest point on infinite lines, if within segment
       if (Rhino.Geometry.Intersect.Intersection.LineLine(ray, axis, out a, out b, 0.001, false))
       {
           Point3d pa = ray.PointAt(a);
           Point3d pb = axis.PointAt(b);
           // Check if pb is within axis segment
           double param = axis.ClosestParameter(pb);
           if (param >= 0.0 && param <= 1.0)
               return pa.DistanceTo(pb);
       }
       return double.MaxValue;
    }

    protected override void OnMouseMove(Rhino.UI.MouseCallbackEventArgs e)
    {
      if (_component.OnPingDocument() == null) { this.Enabled = false; return; }

      // DRAGGING
      if (_controller.DragIndex != -1)
      {
        var view = e.View.ActiveViewport;
        Line pickRay;
        
        if (view.GetFrustumLine(e.ViewportPoint.X, e.ViewportPoint.Y, out pickRay))
        {
            Point3d? candidatePos = null;

            // 1. Calculate Raw Position / Constraint Position
            if (_controller.ConstraintAxis != Vector3d.Unset)
            {
                // Project Ray onto Infinite Line defined by DragOrigin and ConstraintAxis
                // Using basic LineLine closest point approach (closest point on axis to ray)
                
                Line axisLine = new Line(_controller.DragOrigin, _controller.DragOrigin + _controller.ConstraintAxis);
                double a, b;
                
                // RhinoCommon LineLine without tolerance finds closest points on infinite lines
                if (Rhino.Geometry.Intersect.Intersection.LineLine(pickRay, axisLine, out a, out b))
                {
                   candidatePos = axisLine.PointAt(b);
                }
            }
            else
            {
               // Planar Drag
               double t;
               if (Rhino.Geometry.Intersect.Intersection.LinePlane(pickRay, _controller.DragPlane, out t))
               {
                  candidatePos = pickRay.PointAt(t);
               }
            }

            if (candidatePos.HasValue)
            {
               Point3d newPt = candidatePos.Value;
               _controller.IsSnapped = false;
               _controller.IsExtensionConstrained = false;

               // A. LINE EXTENSION CONSTRAINT (Inference)
               // Only check if dragging freely (not locked by Gumball) AND Extension Snapping is enabled
               bool isAxisLocked = (_controller.ConstraintAxis != Vector3d.Unset);
               if (!isAxisLocked && _controller.SnapToExtension)
               {
                   // Define the axis of the line being dragged (from its other endpoint)
                   int otherIndex = _controller.DragIndex ^ 1; // 0->1, 1->0, 2->3 etc.
                   Point3d fixedPt = _controller.Points[otherIndex];
                   Vector3d dir = _controller.DragOrigin - fixedPt; // Original direction vector
                   
                   if (dir.Length > 1e-6) // Ignore zero length lines
                   {
                       // Create infinite extension line
                       Line extLine = new Line(fixedPt, fixedPt + dir);
                       
                       // Check proximity of Ray to this line
                       double a, b;
                       if (Rhino.Geometry.Intersect.Intersection.LineLine(pickRay, extLine, out a, out b))
                       {
                           // Point on line
                           Point3d projPt = extLine.PointAt(b);
                           
                           // Screen Projection
                           var screenProj = view.WorldToClient(projPt);
                           
                           // Mouse position
                           double mx = e.ViewportPoint.X;
                           double my = e.ViewportPoint.Y;
                           
                           double dScreen = Math.Sqrt(Math.Pow(screenProj.X - mx, 2) + Math.Pow(screenProj.Y - my, 2));
                           
                           // Use snapping tolerance (e.g. 15px) -> reduced to 0.35 for stricter release
                           if (dScreen < _controller.Tolerance * 0.35)
                           {
                               newPt = projPt;
                               _controller.IsExtensionConstrained = true;
                               _controller.ExtensionLine = extLine;
                           }
                       }
                   }
               }
               
               // 2. SNAP to SURFACE 
               // Condition: Snap enabled AND (Extension not active OR Extension doesn't override)
               // AND Gumball Axis not overriding
               bool canSnapSrf = (!_controller.IsExtensionConstrained || !_controller.ExtensionOverridesSnaps)
                                 && (!isAxisLocked || !_controller.AxisMoveOverrideSnaps);
               
               if (_controller.SnapToSurface && _controller.TargetSurface != null && canSnapSrf)
               {
                   Point3d closest = _controller.TargetSurface.ClosestPoint(newPt);
                   newPt = closest; 
               }

               // 3. SNAP to GEOMETRY
               // Condition: Snap enabled AND (Extension not active OR Extension doesn't override)
               // AND Gumball Axis not overriding
               bool canSnapGeom = (!_controller.IsExtensionConstrained || !_controller.ExtensionOverridesSnaps)
                                  && (!isAxisLocked || !_controller.AxisMoveOverrideSnaps);

               if (_controller.SnapToGeometry && canSnapGeom)
               {
                   Point3d snapPt = newPt;
                   double bestDist = double.MaxValue;
                   bool vertexSnapped = false;

                   // Use 50% of tolerance
                   double snapTol = _controller.Tolerance * 0.5;

                   // Mouse position on screen
                   double mx = e.ViewportPoint.X;
                   double my = e.ViewportPoint.Y;

                   // A. Snap to Vertices (Priority 1)
                   for (int i=0; i<_controller.Points.Count; i++)
                   {
                       if (i == _controller.DragIndex) continue;
                       
                       // Project candidate point to screen
                       var screenPt = view.WorldToClient(_controller.Points[i]);
                       
                       double dx = screenPt.X - mx;
                       double dy = screenPt.Y - my;
                       double distScreen = Math.Sqrt(dx*dx + dy*dy);

                       if (distScreen < snapTol && distScreen < bestDist) {
                           bestDist = distScreen;
                           snapPt = _controller.Points[i];
                           vertexSnapped = true;
                           _controller.IsSnapped = true;
                       }
                   }

                   // B. Snap to Lines (Priority 2) - Only if no vertex found
                   if (!vertexSnapped)
                   {
                        for (int j = 0; j < _controller.Points.Count - 1; j += 2)
                        {
                            // Avoid snapping to self (lines connected to dragged point)
                            if (_controller.DragIndex == j || _controller.DragIndex == j + 1) continue;

                            Point3d p1 = _controller.Points[j];
                            Point3d p2 = _controller.Points[j+1];

                            // Screen Projection
                            var s1 = view.WorldToClient(p1);
                            var s2 = view.WorldToClient(p2);

                            // Distance Point to Segment (2D)
                            double px = s2.X - s1.X;
                            double py = s2.Y - s1.Y;
                            double lenSq = px*px + py*py;
                            double u = ((mx - s1.X) * px + (my - s1.Y) * py) / (lenSq > 0 ? lenSq : 1.0);
                            
                            if (u < 0) u = 0; 
                            if (u > 1) u = 1;

                            double cx = s1.X + u * px;
                            double cy = s1.Y + u * py;
                            
                            double dx = mx - cx;
                            double dy = my - cy;
                            double distScreen = Math.Sqrt(dx*dx + dy*dy);

                            if (distScreen < snapTol && distScreen < bestDist) 
                            {
                                bestDist = distScreen;
                                
                                // Calculate 3D Snap Point on Line
                                Line targetLine = new Line(p1, p2);
                                double a, b;
                                if (Rhino.Geometry.Intersect.Intersection.LineLine(pickRay, targetLine, out a, out b))
                                {
                                    // Constrain to segment
                                    Point3d rawPt = targetLine.PointAt(b);
                                    double t = targetLine.ClosestParameter(rawPt);
                                    if (t < 0) t = 0; if (t > 1) t = 1;
                                    snapPt = targetLine.PointAt(t);
                                    _controller.IsSnapped = true;
                                }
                            }
                        }
                   }
                   
                   if (_controller.IsSnapped) newPt = snapPt;
               }

               _controller.Points[_controller.DragIndex] = newPt;
               _controller.CurrentSnapPoint = newPt; // For display
               
               _component.ExpireSolution(true);
            }
        }
      }
      // HOVERING
      else
      {
        double minDist = _controller.Tolerance;
        int closest = -1;
        var pts = _controller.Points;
        var view = e.View.ActiveViewport;
        
        int mx = (int)e.ViewportPoint.X;
        int my = (int)e.ViewportPoint.Y;

        // Try to keep selection if interacting with Gumball
        bool isOnGumball = false;
        Vector3d hoverAxis = Vector3d.Unset;

        if (_controller.UseGumball && _controller.HoverIndex != -1)
        {
            Point3d pt = pts[_controller.HoverIndex];
            
            // 1. Dead Zone Check (Screen Space)
            // Ensure we can grab the point center without hitting axes
            Point2d sPt = view.WorldToClient(pt);
            double distToCenter = Math.Sqrt(Math.Pow(sPt.X - mx, 2) + Math.Pow(sPt.Y - my, 2));
            double deadZone = 12.0; // Pixels

            // Only check axes if we are OUTSIDE the dead zone
            if (distToCenter > deadZone)
            {
               Line ray;
               if (view.GetFrustumLine(e.ViewportPoint.X, e.ViewportPoint.Y, out ray))
               {
                   double scale = 1.0;
                   double pixelsPerUnit;
                   view.GetWorldToScreenScale(pt, out pixelsPerUnit);
                   if (pixelsPerUnit > 0) scale = 80.0 / pixelsPerUnit;

                   Line lx = new Line(pt, pt + Vector3d.XAxis * scale);
                   Line ly = new Line(pt, pt + Vector3d.YAxis * scale);
                   Line lz = new Line(pt, pt + Vector3d.ZAxis * scale);

                   // 2. Expanded Tolerance
                   // Make axes easier to grab when not in center
                   double screenTol = _controller.Tolerance * 0.8; // e.g. 24px
                   double worldTol = screenTol;
                   if (pixelsPerUnit > 0) worldTol /= pixelsPerUnit;

                   if (DistLineLine(ray, lx) < worldTol) hoverAxis = Vector3d.XAxis;
                   else if (DistLineLine(ray, ly) < worldTol) hoverAxis = Vector3d.YAxis;
                   else if (DistLineLine(ray, lz) < worldTol) hoverAxis = Vector3d.ZAxis;

                   if (hoverAxis != Vector3d.Unset)
                   {
                       isOnGumball = true;
                       closest = _controller.HoverIndex; // Maintain selection
                   }
               }
            }
        }
        
        // Normal Point Search
        if (!isOnGumball)
        {
            for (int i = 0; i < pts.Count; i++)
            {
              var screenPt = view.WorldToClient(pts[i]);
              double dx = screenPt.X - mx;
              double dy = screenPt.Y - my;
              double dist = Math.Sqrt(dx*dx + dy*dy);

              if (dist < minDist)
              {
                minDist = dist;
                closest = i;
              }
            }
        }

        if (_controller.HoverIndex != closest || _controller.HoverAxis != hoverAxis)
        {
          _controller.HoverIndex = closest;
          _controller.HoverAxis = hoverAxis;
          e.View.Redraw();
        }
      }
      base.OnMouseMove(e);
    }

    protected override void OnMouseUp(Rhino.UI.MouseCallbackEventArgs e)
    {
      if (_controller.DragIndex != -1)
      {
        _controller.DragIndex = -1;
        _controller.ConstraintAxis = Vector3d.Unset;
        _controller.IsSnapped = false;
        if (_component != null) _component.ExpireSolution(true);
      }
      base.OnMouseUp(e);
    }
  }
  // </Custom additional code> 
}
# ---------- end live_edit_geometry ----------
swap = Python3Script(rf_system=rf_system, lines=live_edit_geometry.out_lines)  # -> out_rf, out_lines; inputs lines: list of Line
# ---------- swap: Python ----------
# venv: caadria_b01

"""
Script to update the out_lines of an RFSystem with new Rhino lines.

Inputs:
    rf_system: The RFSystem object to update.
    lines: A list of Rhino.Geometry.Line objects (the new out_lines).

Outputs:
   out_rf: The updated RFSystem with new out_lines.
"""

import Rhino
from compas.geometry import Point
from compas.geometry import Line
from compas_ghpython import warning


def rhino_line_to_compas(r_line):
    """Convert a Rhino Line to a Compas Line."""
    s = r_line.From
    e = r_line.To
    return Line(Point(s.X, s.Y, s.Z), Point(e.X, e.Y, e.Z))


if rf_system and lines:
    # 1. Create a copy of the system to avoid mutating the input in-place
    # This assumes RFSystem has a .copy() method (which we checked it does)
    new_system = rf_system.copy()
    
    # 2. Get all edges from the mesh
    # Note: mesh.edges() is a generator, so we convert to list for indexing/zipping
    # The order of edges is deterministic, so as long as the input 'lines' 
    # were generated from this same mesh's edges originally, the order matches.
    edges = list(new_system.mesh.edges())

    # 3. Validation
    if len(edges) != len(lines):
        print("Error: Edge count ({}) does not match Line count ({})".format(len(edges), len(lines)))
        out_rf = None
    else:
        # 4. Update the 'centerline' attribute for each edge
        for edge, r_line in zip(edges, lines):
            if r_line and r_line.IsValid:
                c_line = rhino_line_to_compas(r_line)
                new_system.mesh.edge_attribute(edge, "centerline", c_line)
        
        out_rf = new_system
        out_lines = out_rf.centerlines
else:
    if not rf_system:
        warning(ghenv.Component, "Input 'rf_system' is missing.")
    if not lines:
        warning(ghenv.Component, "Input 'lines' is missing.")
    out_rf = None
# ---------- end swap ----------

# ----
# Timber Model
dam_3 = DataDam(DataA=swap.out_rf, BufferDelay=10000000, BufferMode=0)
py_compas_19 = CompasPyTemplate(
    rf_system=dam_3,
    process_joinery=Toggle(True),
    beam_width=Slider(0.05, range=0..0.2),
    beam_height=Slider(0.05, range=0..0.2),
    tolerance=Slider(0.02, range=0..0.5))  # -> timber_model, beams, joining_errors
# ---------- py_compas_19: Python ----------
# venv: caadria_b01

from compas_rhino.devtools import DevTools
DevTools.ensure_path()
ghenv.Component.Message = "Timber model"

# -------------------- IMPORTS ---------------------
from lib_timber_model import TimberModelCreator

# ------------------- EXECUTION --------------------

# Copy the RF system on start, because that's the way Grasshopper always behaves
rf_system = rf_system.copy()

# Initialize creator
creator = TimberModelCreator(rf_system, beam_width, beam_height, tolerance=tolerance)

# Create model and apply joints
timber_model = creator.create_timber_model(process_joinery=process_joinery)
joining_errors = creator.joining_errors

if len(joining_errors):
    ghenv.Component.Message = f"Found {len(joining_errors)} joining errors!"

# Output geometry
beams = []
geometry_errors = []
for beam in timber_model.beams:
    try:
        beams.append(beam.geometry)
    except Exception as e:
        geometry_errors.append(e)
        print(f"Could you add geometry of beam: {e}")

if len(geometry_errors) > 0:
    ghenv.Component.Message = f"{len(geometry_errors)} beams failed to generate geometry!"
# ---------- end py_compas_19 ----------
draw_7 = COMPASDraw(cg=py_compas_19.beams)  # -> rg; same code as draw_2
wires = BrepWireframe(Brep=draw_7, Density=-1)
timber_model = Data(py_compas_19.timber_model)
preview = CustomPreview(Geometry=draw_7, Material=ColourSwatch(SwatchColor=RGBA(214, 188, 139, 144)))
preview_2 = CustomPreview(Geometry=wires, Material=ColourSwatch(SwatchColor=RGB(0, 0, 0)))

# ----
# Stats and Arrange
dam_4 = DataDam(DataA=timber_model, BufferDelay=10000000, BufferMode=0)

pt_3 = Point(Point(2.31887332, 8.754053132, 0))
py_compas_20 = CompasPyTemplate(
    timber_model=dam_4,
    origin=pt_3,
    stock_length=Slider(6, range=0..10),
    saw_gap=Slider(0.02, range=0..0.05),
    beam_spacing=Slider(0.6, range=0..1),
    beam_offset=Slider(0.2, range=0..1),
    price_lm=Slider(5.1, range=0..10))  # -> model_stats, visual_stocks, visual_beams, packing_stats; inputs origin: Point3d, stock_length: Double, saw_gap: Double, price_lm: Double
# ---------- py_compas_20: Python ----------
# venv: caadria_b01

from compas_rhino.devtools import DevTools
DevTools.ensure_path()

from compas_rhino.conversions import point_to_compas
from lib_extra_packing_stats import get_general_stats, solve_bin_packing, visualize_packing, get_packing_stats




model_stats = get_general_stats(timber_model)

stocks = solve_bin_packing(timber_model, stock_length, saw_gap)
origin = point_to_compas(origin)
visual_stocks, visual_beams = visualize_packing(stocks, origin, stock_length, beam_spacing, beam_offset)
packing_stats = get_packing_stats(stocks, stock_length, price_lm)
# ---------- end py_compas_20 ----------
panel = Panel(py_compas_20.packing_stats)
panel_2 = Panel(py_compas_20.model_stats)

submit = Button()
# Antikythera: submit design
# IP Address of Orchestrator ->
panel_3 = Panel("127.0.0.1")

send_model_to_antikythera = Python3Script(timber_model=timber_model, broker_host=panel_3, enabled=Toggle(True), submit=submit)
# ---------- send_model_to_antikythera: Python ----------
# venv: caadria_b01

"""Design Agent — design.gh

Listens for a 'design.compute' task from the orchestrator.
When a task arrives the component re-solves and exposes any orchestrator
params on the `params` output.  Wire your TimberModel into `timber_model`
and pulse `submit` when you are happy with the design.

The agent sends the model back to the orchestrator which stores it in the
session and forwards it to the Fabrication agent.
"""
from compas_rhino.devtools import DevTools
DevTools.ensure_path()

import Grasshopper
import scriptcontext as sc

from compas_eve.ghpython import BackgroundWorker
from lib_gh_agent import run_agent
from lib_gh_agent import stop_agent

DEFAULT_TASK_TYPE = "design.submit"

def print_sticky():
    for key, value in sc.sticky.items():
        if key.startswith("background"):
            print(f"worker - {value.launcher.launcher_id}")


class DesignAgentComponent(Grasshopper.Kernel.GH_ScriptInstance):
    def RunScript(self, timber_model, broker_host, enabled, submit):
        print_sticky()
        broker_host = broker_host or "127.0.0.1"
        broker_port = 1883
        task_type = DEFAULT_TASK_TYPE

        # ── Stop ──────────────────────────────────────────────────────────────
        if not enabled:
            BackgroundWorker.stop_instance_by_component(ghenv)  # noqa: F821
            ghenv.Component.Message = "disabled"  # noqa: F821
            return None

        # ── BackgroundWorker ──────────────────────────────────────────────────
        # listetning starts
        worker = BackgroundWorker.instance_by_component(
            ghenv,  # noqa: F821
            lambda w, tt=task_type, bh=broker_host, bp=broker_port: run_agent(
                w, tt, bh, bp, "FabricationAgent"
            ),
            dispose_function=stop_agent,
            auto_set_done=False,
        )
        print("is_done", worker.is_done())
        print("is_working", worker.is_working())
        if not worker.is_working() and not worker.is_done():
            worker.start_work()
            ghenv.Component.Message = "starting…"  # noqa: F821
            return None

        # ── Expose task data ───────────────────────────────────────────────────
        pending_task = getattr(worker, "pending_task", None)

        print("launcher_id", worker.launcher.launcher_id)
        print("events dict", worker.launcher.transport._events)
        print("pending_task", pending_task)
        if submit and pending_task:
            pending_task.task_outputs = {"timber_model": timber_model}
            if pending_task.event:
                pending_task.event.set()

            ghenv.Component.Message = "submitted"  # noqa: F821
            return None

        # if assigned task by antikythera
        if pending_task:
            # we got assigned a task by the orchestrator
            ghenv.Component.Message = "task received — generate toolpaths!"  # noqa: F821
            return None            

        ghenv.Component.Message = "listening"  # noqa: F821
        return None
# ---------- end send_model_to_antikythera ----------

draw_8 = COMPASDraw(cg=py_compas_20.visual_stocks)  # -> rg; same code as draw
draw_9 = COMPASDraw(cg=py_compas_20.visual_beams)  # -> rg; same code as draw
preview_3 = CustomPreview(Geometry=draw_8, Material=ColourSwatch(SwatchColor=RGB(142, 199, 125)))
preview_4 = CustomPreview(Geometry=draw_9, Material=ColourSwatch(SwatchColor=RGB(214, 188, 139)))

pt_4 = Point(Point(8.000477213, 13.94173332, 0))
swatch = ColourSwatch(SwatchColor=RGB(79, 67, 67))
pt_5 = Point(Point(8.000477213, 11.60903239, 0))
tag = TextTag3D(Location=pt_4, Text=panel_2, Size="0.2", Colour=swatch, Justification=7)
tag_2 = TextTag3D(Location=pt_5, Text=panel, Size="0.2", Colour=swatch, Justification=7)
