# Grasshopper definition 01_fabricator.ghx (Grasshopper 1.0.8)

# ----
# Antikythera Receive
toggle = BooleanToggle(False)
fabrication_receiver = Python3Script(enabled=toggle)  # -> pending_task; inputs broker_host: String
# ---------- fabrication_receiver: Python ----------
# venv: caadria_b01

"""Fabrication Receiver — fabrication.gh

Listens for a 'fabrication.toolpaths' task from the orchestrator.
Outputs the TimberModel and task metadata for downstream toolpath generation.

Use the companion Fabrication Submit component to send computed toolpaths
back once they have been reviewed and approved. The two components share the
BackgroundWorker via sc.sticky keyed on task_type to avoid a GH loop.
"""
from compas_rhino.devtools import DevTools
DevTools.ensure_path()

import Grasshopper
import scriptcontext as sc
from compas_ghpython import create_id

from compas_eve.ghpython import BackgroundWorker
from lib_gh_agent import run_agent
from lib_gh_agent import stop_agent

DEFAULT_TASK_TYPE = "fabrication.manager"



class FabricationReceiverComponent(Grasshopper.Kernel.GH_ScriptInstance):
    def RunScript(self, broker_host: str, enabled):
        broker_host = broker_host or "127.0.0.1"
        broker_port = 1883
        task_type = DEFAULT_TASK_TYPE
        # ── Stop ──────────────────────────────────────────────────────────────

        if not enabled:
            BackgroundWorker.stop_instance_by_component(ghenv)  # noqa: F821
            ghenv.Component.Message = "disabled"  # noqa: F821
            return None

        # ── BackgroundWorker ──────────────────────────────────────────────────
        # listetning starts
        worker = BackgroundWorker.instance_by_component(
            ghenv,  # noqa: F821
            run_agent,
            dispose_function=stop_agent,
            auto_set_done=False,
            args=(task_type, broker_host, broker_port, "FabricationAgent")
        )
    
        if not worker.is_working() and not worker.is_done():
            worker.start_work()
            ghenv.Component.Message = "starting…"  # noqa: F821
            return None

        # ── Expose task data ───────────────────────────────────────────────────
        pending_task = getattr(worker, "pending_task", None)
        print(pending_task)
        print(worker.launcher.transport._events)
        # if assigned task by antikythera
        if pending_task:
            # we got assigned a task by the orchestrator
            ghenv.Component.Message = "task received — generate toolpaths!"  # noqa: F821
            return pending_task            

        ghenv.Component.Message = "listening"  # noqa: F821
        return None
# ---------- end fabrication_receiver ----------
deconstruct_task = Python3Script(pending_task=fabrication_receiver)  # -> timber_model, beams
# ---------- deconstruct_task: Python ----------
# venv: caadria_b01

import System
import Rhino
import Grasshopper

import rhinoscriptsyntax as rs

from compas_rhino.conversions import point_to_rhino


class BeamLabel:
    def __init__(self, text, color, location, size):
        self.text = text
        self.color = color
        self.location = location
        self.size = size


class DeconstructTask(Grasshopper.Kernel.GH_ScriptInstance):
    def __init__(self):
        super().__init__()
        self._labels = []

    def RunScript(self, pending_task):
        timber_model = None        
        if pending_task:
            timber_model = pending_task.task_data["inputs"].get("timber_model")
        
        # Output geometry
        beams = []
        if timber_model:
            # TODO: consider removing this if too heavy and just serialize processings
            timber_model.process_joinery()

            geometry_errors = []
            for beam in timber_model.beams:
                try:
                    beams.append(beam.geometry)
                except Exception as e:
                    geometry_errors.append(e)
                    print(f"Could you add geometry of beam: {e}")
                self._labels.append(
                    BeamLabel(
                        text=str(beam.graphnode), 
                        color=System.Drawing.Color.White, 
                        location=point_to_rhino(beam.centerline.midpoint), 
                        size=24
                    )
                )

            if len(geometry_errors) > 0:
                ghenv.Component.Message = f"{len(geometry_errors)} beams failed to generate geometry!"

        return timber_model, beams

    def DrawViewportMeshes(self, args):
        # helps identifying the beams
        for label in self._labels:
            args.Display.Draw2dText(label.text, label.color, label.location, True, label.size)
# ---------- end deconstruct_task ----------

draw = COMPASDraw(cg=deconstruct_task.beams)  # -> rg
#   port cg: The COMPAS geometry or datastructure to be drawn.
#   port rg: The Rhino geometry object.
# ---------- draw: Python ----------
# venv: caadria_b01

from typing import Any

import Grasshopper

from compas.scene import SceneObject


class CompasToRhinoGeometry(Grasshopper.Kernel.GH_ScriptInstance):
    def RunScript(self, cg):
        if not cg:
            return None

        return SceneObject(item=cg).draw()
# ---------- end draw ----------
beams_from_model = Python3Script(model=deconstruct_task.timber_model)  # -> to_fabricate_beams, fabricated_beams
# ---------- beams_from_model: Python ----------
# venv: caadria_b01

from compas_rhino.devtools import DevTools
DevTools.ensure_path()

from lib_timber_model import model_process_joinery
beams = None
if model:
    model_process_joinery(model)
    fabricated_beams = []
    to_fabricate_beams = []
    for beam in model.beams:
        if beam.attributes.get("is_fabricated", False):
            fabricated_beams.append(beam)
        else:
            to_fabricate_beams.append(beam)
# ---------- end beams_from_model ----------

beam_id = Panel("10")
# Choose beam
number_slider = Slider(14, range=0..100)

choose_beam = Python3Script(B=beams_from_model.to_fabricate_beams, i=beam_id)  # -> b; inputs B: list, i: Int32
# ---------- choose_beam: Python ----------
import random

b = None
B = [item for item in B if item is not None]
if B:
    for beam in B:
        if beam.graphnode == i:
            b = beam 
            break
    if b is None:
        b = B[random.randint(0, len(B))]
# ---------- end choose_beam ----------

# ----
# Stats and Arrange
dam = DataDam(DataA=deconstruct_task.timber_model, BufferDelay=10000000, BufferMode=0)

pt = Point(Point(2.31887332, 8.754053132, 0))
py_compas = CompasPyTemplate(
    timber_model=dam,
    origin=pt,
    stock_length=Slider(6, range=0..10),
    saw_gap=Slider(0.02, range=0..0.05),
    beam_spacing=Slider(0.6, range=0..1),
    beam_offset=Slider(0.2, range=0..1),
    price_lm=Slider(5.1, range=0..10))  # -> model_stats, visual_stocks, visual_beams, packing_stats; inputs origin: Point3d, stock_length: Double, saw_gap: Double, price_lm: Double
# ---------- py_compas: Python ----------
# venv: caadria_b01

from compas_rhino.devtools import DevTools
DevTools.ensure_path()

from compas_rhino.conversions import point_to_compas
from lib_extra_packing_stats import get_general_stats, solve_bin_packing, visualize_packing, get_packing_stats



if timber_model:
    model_stats = get_general_stats(timber_model)

    stocks = solve_bin_packing(timber_model, stock_length, saw_gap)
    origin = point_to_compas(origin)
    visual_stocks, visual_beams = visualize_packing(stocks, origin, stock_length, beam_spacing, beam_offset)
    packing_stats = get_packing_stats(stocks, stock_length, price_lm)
# ---------- end py_compas ----------
panel = Panel(py_compas.model_stats)
panel_2 = Panel(py_compas.packing_stats)

# ----
# Preview: Current Beam
beam_preview = Python3Script(beam=choose_beam)  # -> out, at_design, at_origin, blank
# ---------- beam_preview: Python ----------
# venv: caadria_b01

from compas.geometry import Transformation
from compas.geometry import Frame

if beam:
    at_design = beam.geometry
    at_origin = beam.elementgeometry
    blank = beam.blank.transformed(Transformation.from_frame_to_frame(beam.frame, Frame.worldXY()))
    print(f"Beam no. {beam.graphnode}\nBlank length: {beam.blank_length}")
# ---------- end beam_preview ----------
draw_2 = COMPASDraw(cg=beam_preview.blank)  # -> rg; same code as draw
draw_3 = COMPASDraw(cg=beam_preview.at_origin)  # -> rg; same code as draw
draw_4 = COMPASDraw(cg=beam_preview.at_design)  # -> rg; same code as draw
wires = BrepWireframe(Brep=draw_2, Density=-1)
preview = CustomPreview(Geometry=wires, Material=ColourSwatch(SwatchColor=RGB(0, 0, 0)))
preview_2 = CustomPreview(Geometry=draw_3, Material=ColourSwatch(SwatchColor=RGB(168, 131, 168)))
preview_3 = CustomPreview(Geometry=draw_4, Material=ColourSwatch(SwatchColor=RGB(255, 0, 255)))
panel_3 = Panel(beam_preview.out)

# ----
# Preview: Fabricated Beams
beam_preview_2 = Python3Script(beam=beams_from_model.fabricated_beams)  # -> at_design
# ---------- beam_preview_2: Python ----------
# venv: caadria_b01

if beam:
    at_design = beam.geometry
# ---------- end beam_preview_2 ----------
draw_5 = COMPASDraw(cg=beam_preview_2)  # -> rg; same code as draw
preview_4 = CustomPreview(Geometry=draw_5, Material=ColourSwatch(SwatchColor=RGBA(145, 145, 145, 236)))

draw_6 = COMPASDraw(cg=py_compas.visual_stocks)  # -> rg
#   port cg: The COMPAS geometry or datastructure to be drawn.
#   port rg: The Rhino geometry object.
# ---------- draw_6: Python ----------
# venv: caadria_b01
"""
Draws COMPAS geometry in Grasshopper.
"""

from typing import Any

import Grasshopper

from compas.scene import SceneObject


class CompasToRhinoGeometry(Grasshopper.Kernel.GH_ScriptInstance):
    def RunScript(self, cg):
        if not cg:
            return None

        return SceneObject(item=cg).draw()
# ---------- end draw_6 ----------
draw_7 = COMPASDraw(cg=py_compas.visual_beams)  # -> rg; same code as draw_6
preview_5 = CustomPreview(Geometry=draw_6, Material=ColourSwatch(SwatchColor=RGB(142, 199, 125)))
preview_6 = CustomPreview(Geometry=draw_7, Material=ColourSwatch(SwatchColor=RGB(214, 188, 139)))

# ----
# Set Fabtication Status
# Antikythera: Submit to Fabrication
button = Button()
fab_status = Python3Script(timber_model=deconstruct_task.timber_model, beam_finished=button, set_next=Button())  # -> timber_model
# ---------- fab_status: Python ----------
# venv: caadria_b01

if timber_model and beam:
    
    if beam_finished:
        beam.attributes["is_fabricated"] = True
        beam.attributes["is_next"] = False
    if set_next:
        # in case it was marked fabricated, reset
        beam.attributes["is_fabricated"] = False
        ghenv.Component.Message = "Marked beam fabricated!"  # noqa: F821
        
        # only one beam is allowed to be next, so reset all others
        for b in timber_model.beams:
            b.attributes["is_next"] = False
        
        beam.attributes["is_next"] = True
        ghenv.Component.Message = "Marked beam next!"  # noqa: F821
timber_model = timber_model
# ---------- end fab_status ----------
fabrication_receiver_2 = Python3Script(pending_task=fabrication_receiver, timber_model=fab_status, submit=Button())  # -> status
# ---------- fabrication_receiver_2: Python ----------
# venv: caadria_b01

"""Fabrication Submit — fabrication_submit.gh

Companion to the Fabrication Receiver component.
Looks up the shared BackgroundWorker via sc.sticky (keyed on task_type),
accepts the computed toolpaths, and sends them back to the orchestrator
when submit is pulsed.

Wire toolpaths from your downstream toolpath generation logic and pulse
submit to approve and release them to the Robot agent.
"""

import Grasshopper
import scriptcontext as sc

from compas_rhino.conversions import plane_to_compas_frame

def all_beams_finished(model):
    return all([beam.attributes.get("is_fabricated", False) for beam in model.beams])

class FabricationSubmitComponent(Grasshopper.Kernel.GH_ScriptInstance):
    def RunScript(self, pending_task, timber_model, submit):
        print("ran!")
        print(getattr(pending_task, "event", None))
        if pending_task is None:
            ghenv.Component.Message = "no receiver"  # noqa: F821
            return "no_receiver"
        if submit and pending_task:
            has_beams = not all_beams_finished(timber_model)
            pending_task.task_outputs = {"timber_model": timber_model, "has_beams": has_beams}
            if pending_task.event:
                print("setting event!")
                pending_task.event.set()

            ghenv.Component.Message = "submitted"  # noqa: F821
            return "submitted"

        if pending_task:
            ghenv.Component.Message = "waiting for approval"  # noqa: F821
            return "pending"

        ghenv.Component.Message = "idle"  # noqa: F821
        return "idle"
# ---------- end fabrication_receiver_2 ----------

pt_2 = Point(Point(8.000477213, 13.94173332, 0))
swatch = ColourSwatch(SwatchColor=RGB(79, 67, 67))
pt_3 = Point(Point(8.000477213, 11.60903239, 0))
tag = TextTag3D(Location=pt_2, Text=panel, Size="0.2", Colour=swatch, Justification=7)
tag_2 = TextTag3D(Location=pt_3, Text=panel_2, Size="0.2", Colour=swatch, Justification=7)
